vi "uLawDecode.gvi"   [LabVIEW NXG]
inputs:
  "x": f64
  "mu": f64
outputs:
  "y": f64
diagram:
  Sign(number=$x) -> (-1, 0, 1=w1)
  Reciprocal(x=$mu) -> w2
  Absolute Value(x=$x) -> w3
  Increment(x=$mu) -> w4
  Power Of X(x=w4, y=w3) -> w5
  Decrement(x=w5) -> w6
  Multiply(w1, w2, w6) -> w7
  $y <- w7
