vi "demodulation_block.gvi"   [LabVIEW NXG]
inputs:
  "data": cluster{"t0": f64, "dt": f64, "Y": c128[]}
  "PSK_params_in": T3
outputs:
  "output bit stream": i8[]
  "recovered complex waveform": cluster{"t0": f64, "dt": f64, "Y": c128[]}
  "Sync_Found?": bool
  "sync found index": f64
types:
  T1 = cluster{"samples per symbol (16)": i32, "symbol map": c128[], "differential PSK": enum{"disable", "enable"}, "PSK type": enum{"normal", "shifted", "offset"}}
  T2 = cluster{"expected sync location (symbols)": i32, "sync sequence": c128[], "sync location uncertainty (symbols)": i32, "sync indent (symbols)": i32}
  T3 = cluster{"psk_system_params": T1, "pulse_shaping_filter_coeffs": f64[], "matched_filter_coeffs": f64[], "sync_params": T2, "sync_seq_bits": i8[]}
diagram:
  Property Node(instance in=$PSK_params_in) -> ("psk_system_params"=w1, "matched_filter_coeffs"=w2, "sync_params"=w3, "pulse_shaping_filter_coeffs"=w4)
  Property Node(instance in=$data) -> ("Y"=w5)
  Is Empty Array(array=w5) -> w6
  case (w6) {
    frame False, Default {
      call "MT Demodulate PSK.gvi"(input complex waveform=$data, PSK system parameters=w1, matched filter coefficients=w2, synchronization parameters=w3, pulse shaping filter coefficients=w4) -> (recovered complex waveform=w9, output bit stream=w7, sync found index=w8)
    }
    frame True {
      w10 = cluster{"t0": f64, "dt": f64, "Y": c128[]} {all zero or empty}
      w7 = i8[] []
      w8 = 0
      w9 = w10
    }
  }
  $"recovered complex waveform" <- w9
  $"output bit stream" <- w7
  $"sync found index" <- w8
  Is Greater Than 0(x=w8) -> w11
  $"Sync_Found?" <- w11
