vi "SoundTestbench.gvi"   [LabVIEW NXG]
panel controls:
  "Packet Message Length (bits)": i32 = 128
  "stop_recording_sound": bool
  "queue_type": i8[]
  "Packet Parameters": T1 = {"Guard Bits "=16, "Sync Bits"=32, "Message Bits"=960, "PN sequence order\nfor Sync"=9}
  "User defined bitstream?": bool = TRUE
  "Cyclic Padding Bits": i32
panel indicators:
  "dt": f64
  "output_packet": i8[][]
  "data": waveform<f64>[]
  "size(s)": i32[]
types:
  T1 = cluster{"Guard Bits ": i32, "Sync Bits": i32, "Message Bits": i32, "PN sequence order\nfor Sync": i32}
  T2 = cluster{"sample rate": f64, "number of channels": i32, "bits per sample": i32}
diagram:
  w1 = T2 {"sample rate"=8000, "number of channels"=1, "bits per sample"=16}
  call "Sound Input Configure.gvi"(device ID=0, sound format=w1, number of samples per channel=8000) -> (task ID=w2, error out=w3)
  call "Sound Input Start.gvi"(task ID=w2, error in=w3) -> (task ID out=w4, error out=w5)
  Obtain Queue(element data type=$queue_type, max queue size (-1, unlimited)=200, name (unnamed)="Sound_to_bit") -> (queue out=w6)
  while {
    call "Sound Input Read.gvi"(task ID=w4, error in=w5, number of samples per channel=800) -> (task ID out=w7, data=w8, error out=w9)
    $data <- w8
    for {
      w10 = each element of w8
      Property Node(instance in=w10) -> ("Y"=w11, "dt"=w12)
      $dt <- w12
    }
    Add(w11, 0.3) -> w13
    Multiply(1000, w13) -> w14
    To Word Integer(number=w14) -> w15
    for {
      w16 = each element of w15
      Number To Boolean Array(number=w16) -> (Boolean array=w18)
      Boolean To Integer(Boolean=w18) -> (0, 1=w19)
      append w19 to w17
    }
    To Word Integer(number=w17) -> w20
    Array Size(array=w20) -> (size(s)=w21)
    Multiply Array Elements(numeric array=w21) -> (product=w22)
    Reshape Array(inArray=w20, size=w22) -> w23
    Array Size(array=w23) -> (size(s)=w24)
    Divide(x=w24, y=$"Packet Message Length (bits)") -> w25
    Round Toward Positive Infinity(x=w25) -> w26
    Multiply(w26, $"Packet Message Length (bits)") -> w27
    Subtract(x=w27, y=w24) -> w28
    To Long Integer(number=w28) -> w29
    Initialize Array(element=0, size=w29) -> w30
    Build Array[ConcatenateInputs=True](w23, w30) -> w31
    Enqueue Element(element=w31, queue=w6)
    stop if $stop_recording_sound
  }
  call "Sound Input Stop.gvi"(task ID=w7, error in=w9) -> (task ID out=w32, error out=w33)
  call "Sound Input Clear.gvi"(task ID=w32, error in=w33)
  Obtain Queue(element data type=i8[] [], name (unnamed)="Sound_to_bit") -> (queue out=w34)
  Dequeue Element(queue=w34) -> (element=w35)
  Property Node(instance in=$"Packet Parameters") -> ("Sync Bits"=w36, "PN sequence order\nfor Sync"=w37, "Guard Bits "=w38, "Message Bits"=w39)
  w40 = $"User defined bitstream?"
  Array Size(array=w35) -> (size(s)=w41)
  Divide(x=w41, y=w39) -> w42
  To Long Integer(number=w42) -> w43
  Initialize Array(element=0, size=w38) -> w44
  call "MT Generate Bits (Galois, PN Order).gvi"(total bits=w36, PN sequence order=w37, reset?=TRUE) -> (output bit stream=w45)
  for (N = w43) (iteration -> i1) {
    case (w40) {
      frame False, Default {
        call "MT Generate Bits (Galois, PN Order).gvi"(total bits=w39, PN sequence order=11) -> (output bit stream=w47)
      }
      frame True {
        Multiply(i1, w39) -> w48
        Array Subset(array=w35, index0=w48, length0=w39) -> w47
      }
    }
    Build Array[ConcatenateInputs=True](w44, w45, w47, w44) -> w49
    Array Subset(array=w47, length0=$"Cyclic Padding Bits")
    append w49 to w46
  }
  Array Size(array=w46) -> (size(s)=w50)
  $"size(s)" <- w50
  $output_packet <- w46
