vi "Tx_main.gvi"   [LabVIEW NXG]
panel controls:
  "IQ_Rate": f64 = 500000
  "f0": f64 = 2450000000
  "Gain": f64 = 10
  "modulation type": T1 = "PSK"
  "PSK type": enum{"normal", "shifted", "offset"} = "normal"
  "samples per symbol": i32 = 16
  "pulse shaping filter": T2 = "Root Raised Cos"
  "filter parameter": f64 = 0.5
  "filter length": i32 = 8
  "stopRecoringSound": bool
  "stopDataEnqueing": bool
  "stopSendingData": bool
  "SamplesPerChannel": i32 = 128
  "multiple": f64 = 1000
  "correction": f64 = 0.02
  "bitsPerSample": i32 = 8
  "SendOnlyZeros": T4 = "Send sound"
panel indicators:
  "data": waveform<f64>[]
  "PacketGraph": cluster{"t0": f64, "dt": f64, "Y": c128[]}
  "IQ Graph": T3[]
  "numOfElementInRadioQueue2": i32
  "numOfElementInSoundQueue": i32
  "numOfElementInSoundQueue2": i32
  "numOfElementInRadioQueue": i32
  "FilterError": error
  "ModulationError": error
  "Sound error": error
  "SentArray": i8[]
types:
  T1 = enum{"FSK", "PSK", "QAM", "MSK", "PAM", "ASK", "CPM"}
  T2 = enum{"none", "Raised Cosine", "Root Raised Cos", "Gaussian"}
  T3 = cluster{"constellation": f64[], "oversampled data": f64[]}
  T4 = enum{"Send sound", "Send only zeros", "Send 010101..."}
  T5 = cluster{"sample rate": f64, "number of channels": i32, "bits per sample": i32}
diagram:
  w1 = $SamplesPerChannel
  w2 = $bitsPerSample
  w3 = $correction
  w4 = $multiple
  Obtain Queue(element data type=i8[] [], max queue size (-1, unlimited)=2000, name (unnamed)="sound_bit_stream") -> (error out=w5, queue out=w6)
  w7 = T5 {"sample rate"=6000, "number of channels"=1, "bits per sample"=16}
  call "Sound Input Configure.gvi"(device ID=0, sound format=w7, sample mode=1, number of samples per channel=8000) -> (task ID=w8, error out=w9)
  call "Sound Input Start.gvi"(task ID=w8, error in=w9) -> (task ID out=w10, error out=w11)
  while {
    Multiply(w1, w2) -> w12
    call "Sound Input Read.gvi"(task ID=w10, error in=w11, number of samples per channel=w1, timeout=-1) -> (task ID out=w13, data=w14, error out=w15)
    for {
      w16 = each element of w14
      Property Node(instance in=w16) -> ("Y"=w17)
    }
    call "shiftAndMultSoundArray.gvi"(soundArray_raw=w17, correction=w3, multiply=w4) -> (processedSoundArray=w18)
    To Unsigned Byte Integer(number=w18) -> w19
    call "intArray2BitStream.gvi"(unsigned 8-bit integer=w19) -> (array=w20)
    Reshape Array(inArray=w20, size=w12) -> w21
    case ($SendOnlyZeros) {
      frame "Send sound", Default {
        w22 = w21
      }
      frame "Send only zeros" {
        Array Size(array=w21) -> (size(s)=w23)
        To Byte Integer(number=0) -> w24
        Initialize Array(element=w24, size=w23) -> w22
      }
      frame "Send 010101..." {
        Array Size(array=w21) -> (size(s)=w25)
        Divide(x=w25, y=2) -> w26
        To Byte Integer(number=0) -> w27
        Initialize Array(element=w27, size=w26) -> w28
        To Byte Integer(number=1) -> w29
        Initialize Array(element=w29, size=w26) -> w30
        Interleave Array(w28, w30) -> w22
      }
    }
    $SentArray <- w22
    call "createPacket.gvi"(dataBitStream=w22) -> (packet=w31)
    Get Queue Status(error in (no error)=w5, queue=w6) -> (# elements in queue=w32, error out=w33, queue out=w34)
    Lossy Enqueue Element(element=w31, error in (no error)=w33, queue=w34)
    $data <- w14
    $numOfElementInSoundQueue <- w32
    stop if $stopRecoringSound
  }
  call "Sound Input Stop.gvi"(task ID=w13, error in=w15) -> (task ID out=w35, error out=w36)
  call "Sound Input Clear.gvi"(task ID=w35, error in=w36)
  $"Sound error" <- w11
  w37 = $"samples per symbol"
  w38 = $"PSK type"
  w39 = $"modulation type"
  w40 = $"pulse shaping filter"
  w41 = $"filter parameter"
  w42 = $"filter length"
  w43 = cluster{"t0": f64, "dt": f64, "Y": c128[]} {"t0"=0, "dt"=1, "Y"=[]}
  Obtain Queue(element data type=w43, max queue size (-1, unlimited)=5000, name (unnamed)="enqueDataForRadio") -> (error out=w44, queue out=w45)
  call "niUSRP Open Tx Session.gvi"(Device names="192.168.10.2", Reset=TRUE) -> (Error Out=w46, Session handle=w47)
  call "niUSRP Configure Signal.gvi"(session handle=w47, IQ rate=$IQ_Rate, carrier frequency=$f0, gain=$Gain, error in (no error)=w46, active antenna="TX1") -> (session handle out=w48, coerced IQ rate=w49)
  while {
    Get Queue Status(error in (no error)=w5, queue=w6) -> (# elements in queue=w50, error out=w51, queue out=w52)
    Dequeue Element(error in (no error)=w51, queue=w52) -> (element=w53, error out=w54, queue out=w55)
    call "modulation_block.gvi"(modulation type=w39, PSK type=w38, pulse shaping filter=w40, filter parameter=w41, filter length=w42, input bit stream=w53, samples per symbol=w37, IQ_Rate=w49) -> (modulated_complex_waveform=w56, FilterError=w57, ModulationError=w58)
    $FilterError <- w57
    $ModulationError <- w58
    Get Queue Status(error in (no error)=w54, queue=w45) -> (# elements in queue=w59, error out=w60, queue out=w61)
    Lossy Enqueue Element(element=w56, error in (no error)=w60, queue=w61)
    $numOfElementInSoundQueue2 <- w50
    $numOfElementInRadioQueue <- w59
    stop if $stopDataEnqueing
  }
  Flush Queue(queue=w55) -> (queue out=w62)
  Release Queue(queue=w62)
  while {
    Get Queue Status(error in (no error)=w44, queue=w45) -> (# elements in queue=w63, error out=w64, queue out=w65)
    Dequeue Element(error in (no error)=w64, queue=w65) -> (element=w66, queue out=w67)
    call "addPadding.gvi"(dataIn=w66) -> (paddedDataOut=w68)
    call "niUSRP Write Tx Data (CDB Cluster).gvi"(session handle=w48, data=w68, end of data?=$stopSendingData) -> (session handle out=w69, Error Out=w70)
    $PacketGraph <- w68
    call "MT Format Constellation.gvi"(waveform=w68) -> (constellation graph=w71)
    $"IQ Graph" <- w71
    $numOfElementInRadioQueue2 <- w63
    stop if $stopSendingData
  }
  Flush Queue(queue=w67) -> (queue out=w72)
  Release Queue(queue=w72)
  call "niUSRP Close Session.gvi"(Handle in=w69, error in (no error)=w70)
