vi "addPadding.gvi"   [LabVIEW NXG]
inputs:
  "dataIn": cluster{"t0": f64, "dt": f64, "Y": c128[]}
outputs:
  "paddedDataOut": cluster{"t0": f64, "dt": f64, "Y": c128[]}
diagram:
  Property Node(instance in=$dataIn) -> (instance out=w1, "Y"=w2)
  Initialize Array(element=0+0i, size=800) -> w3
  Build Array[ConcatenateInputs=True](w3, w2, w3) -> w4
  Property Node(instance in=w1, "Y"=w4) -> (instance out=w5)
  $paddedDataOut <- w5
