vi "createPacket.gvi"   [LabVIEW NXG]
inputs:
  "dataBitStream": i8[]
outputs:
  "packet": i8[]
diagram:
  call "MT Generate Bits (Galois, PN Order).gvi"(total bits=32, PN sequence order=9) -> (output bit stream=w1)
  Initialize Array(element=0, size=40) -> w2
  Build Array[ConcatenateInputs=True](w2, w1, $dataBitStream, w2) -> w3
  $packet <- w3
