vi "shiftAndMultSoundArray.gvi"   [LabVIEW NXG]
inputs:
  "soundArray_raw": f64[]
  "correction": f64
  "multiply": f64
outputs:
  "processedSoundArray": f64[]
diagram:
  for {
    w1 = each element of $soundArray_raw
    Add(w1, $correction) -> w3
    Multiply(w3, $multiply) -> w4
    Is Greater(x=w4, y=255) -> w5
    case (w5) {
      frame False, Default {
        Is Less(x=w4, y=0) -> w7
        case (w7) {
          frame False, Default {
            w6 = w4
          }
          frame True {
            w6 = 0
          }
        }
      }
      frame True {
        w6 = 255
      }
    }
    append w6 to w2
  }
  $processedSoundArray <- w2
