vi "Tx_packetconstructor.gvi"   [LabVIEW NXG]
inputs:
  "Packet Parameters": T1 = {"Guard Bits "=16, "Sync Bits"=32, "PN sequence order\nfor Sync"=9}
panel controls:
  "queue_type": i8[] = [1]
  "stop": bool
  "queue_type_2": i8[] = [1]
types:
  T1 = cluster{"Guard Bits ": i32, "Sync Bits": i32, "PN sequence order\nfor Sync": i32}
diagram:
  Obtain Queue(element data type=$queue_type, name (unnamed)="Sound_to_bit") -> (queue out=w1)
  Property Node(instance in=$"Packet Parameters") -> ("Sync Bits"=w2, "PN sequence order\nfor Sync"=w3, "Guard Bits "=w4)
  Initialize Array(element=0, size=w4) -> w5
  call "MT Generate Bits (Galois, PN Order).gvi"(total bits=w2, PN sequence order=w3, reset?=TRUE) -> (output bit stream=w6)
  while {
    Obtain Queue(element data type=$queue_type_2, name (unnamed)="1024bitq") -> (queue out=w7)
    Get Queue Status(queue=w1) -> (queue out=w8)
    Dequeue Element(queue=w8) -> (element=w9)
    Build Array[ConcatenateInputs=True](w5, w6, w9, w5) -> w10
    Enqueue Element(element=w10, queue=w7)
    Get Queue Status(queue=w7)
    stop if $stop
  }
