vi "subCallConfigRx.gvi"   [LabVIEW NXG]
inputs:
  "session handle": niUSRP
  "Rx Parameters": T1 = {"Rx IQ Sampling\nRate [s/sec]"=200000, "Rx\nFrequency [Hz]"=433920000, "Rx Gain [dB]"=0, "Rx Antenna"="RX2"}
  "error in": error
outputs:
  "session handle out": niUSRP
  "Actual Rx Parameters": T1
  "error out": error
types:
  T1 = cluster{"Rx IQ Sampling\nRate [s/sec]": f64, "Rx\nFrequency [Hz]": f64, "Rx Gain [dB]": f64, "Rx Antenna": string}
diagram:
  Property Node(instance in=$"Rx Parameters") -> (instance out=w1, "Rx IQ Sampling\nRate [s/sec]"=w2, "Rx\nFrequency [Hz]"=w3, "Rx Gain [dB]"=w4, "Rx Antenna"=w5)
  call "niUSRP Configure Signal.gvi"(session handle=$"session handle", IQ rate=w2, carrier frequency=w3, gain=w4, error in (no error)=$"error in", active antenna=w5) -> (session handle out=w6, coerced IQ rate=w7, coerced carrier frequency=w8, coerced gain=w9, Error Out=w10)
  $"session handle out" <- w6
  Property Node(instance in=w1, "Rx IQ Sampling\nRate [s/sec]"=w7, "Rx Gain [dB]"=w9, "Rx\nFrequency [Hz]"=w8) -> (instance out=w11)
  $"Actual Rx Parameters" <- w11
  $"error out" <- w10
