vi "subDCOffset.gvi"   [LabVIEW NXG]
inputs:
  "Input signal samples": c128[]
outputs:
  "Output signal samples": c128[]
diagram:
  Complex To Real Imaginary(x + iy=$"Input signal samples") -> (x=w1, y=w2)
  call "Hanning Window (DBL).gvi"(x=w1) -> (windowed x=w3)
  call "Mean (DBL).gvi"(X=w3) -> (mean=w4)
  Divide(x=w4, y=0.5) -> w5
  Subtract(x=w1, y=w5) -> w6
  call "Hanning Window (DBL).gvi"(x=w2) -> (windowed x=w7)
  call "Mean (DBL).gvi"(X=w7) -> (mean=w8)
  Divide(x=w8, y=0.5) -> w9
  Subtract(x=w2, y=w9) -> w10
  Real And Imaginary To Complex(x=w6, y=w10) -> w11
  $"Output signal samples" <- w11
