vi "sub_Check_Rx_Packet_Validity.gvi"   [LabVIEW NXG]
inputs:
  "Input Bit Stream": cluster{"bit stream ": i8[][], "Enable?": bool}
  "Packet Parameters": T5 = {"Guard Bits "=30, "Sync Bits"=20, "Message Bits"=128, "Number of Packets \nto Expect"=46, "PN Sequence Order\nfor Sync"=31}
  "PSK Init Parameters": T4
outputs:
  "Output Bit Stream": T1
types:
  T1 = cluster{"bit stream ": i8[][], "Sync Valid?": bool[], "Decoded Pkt Numbers": u32[], "Enable?": bool}
  T2 = cluster{"samples per symbol (16)": i32, "symbol map": c128[], "differential PSK": enum{"disable", "enable"}, "PSK type": u16}
  T3 = cluster{"expected sync location (symbols)": i32, "sync sequence": c128[], "sync location uncertainty (symbols)": i32, "sync indent (symbols)": i32}
  T4 = cluster{"PSK system parameters": T2, "pulse shaping filter coefficients": f64[], "matched filter coefficients": f64[], "synchronization parameters": T3, "Sync Bits": i8[]}
  T5 = cluster{"Guard Bits ": i32, "Sync Bits": i32, "Message Bits": i32, "Number of Packets \nto Expect": i32, "PN Sequence Order\nfor Sync": i32}
diagram:
  Property Node(instance in=$"Input Bit Stream") -> ("bit stream "=w1, "Enable?"=w2)
  case (w2) {
    frame False, Default {
      w3 = [FALSE]
      w4 = [0]
      w5 = FALSE
    }
    frame True {
      Property Node(instance in=$"Packet Parameters") -> ("Sync Bits"=w6)
      Array Subset(array=w1, index1=0, length1=w6) -> w7
      Is Not Equal To 0(x=w7) -> w8
      Property Node(instance in=$"PSK Init Parameters") -> ("Sync Bits"=w9)
      Is Not Equal To 0(x=w9) -> w10
      for (N = w6) {
        w11 = each element of w8
        Logical Exclusive Or[output inverted](w11, w10) -> w12
        And Array Elements(Boolean array=w12) -> (logical AND=w13)
        append w13 to w3
      }
      Or Array Elements(Boolean array=w3) -> (logical OR=w5)
      Array Subset(array=w1, index1=w6, length1=32) -> w14
      Is Not Equal To 0(x=w14) -> w15
      for {
        w16 = each element of w15
        Boolean Array To Number[SignExtensionMode=1](Boolean array=w16) -> (number=w17)
        append w17 to w4
      }
    }
  }
  Property Node(instance in=T1 {all zero or empty}, "bit stream "=w1, "Enable?"=w5, "Sync Valid?"=w3, "Decoded Pkt Numbers"=w4) -> (instance out=w18)
  $"Output Bit Stream" <- w18
