vi "sub_Extract_Packet_Boundaries - G.gvi"   [LabVIEW NXG]
inputs:
  "Thresholded Signal": bool[]
outputs:
  "packet_start_loc": i32[]
  "packet_end_loc": i32[]
  "Packet Detection Error?": bool
diagram:
  Boolean To Integer(Boolean=$"Thresholded Signal") -> (0, 1=w1)
  Is Empty Array(array=$"Thresholded Signal") -> w2
  Add Array Elements(numeric array=w1) -> (sum=w3)
  Is Equal To 0(x=w3) -> w4
  Logical Or(w2, w4) -> w5
  case (w5) {
    frame False, Default {
      Is Equal To 0(x=w1) -> w9
      Is Equal(x=1, y=w1) -> w10
      s1 = FALSE  # shift register
      s2 = i32[] []  # shift register
      s3 = i32[] []  # shift register
      for (iteration -> i1) {
        w11 = each element of w9
        w12 = each element of w10
        Logical And(not s1, w12) -> w13
        case (w13) {
          frame False, Default {
            w14 = s2
            w15 = s1
          }
          frame True {
            Build Array[ConcatenateInputs=True](s2, i1) -> w14
            w15 = TRUE
          }
        }
        Logical And(w15, w11) -> w16
        case (w16) {
          frame False, Default {
            w17 = s3
            w18 = w15
          }
          frame True {
            Decrement(x=i1) -> w19
            Build Array[ConcatenateInputs=True](s3, w19) -> w17
            w18 = FALSE
          }
        }
        next s1 = w18
        next s2 = w14
        next s3 = w17
      }
      Is Empty Array(array=s2) -> w20
      case (s1) {
        frame False, Default {
          w8 = s3
        }
        frame True {
          Array Size(array=w1) -> (size(s)=w21)
          Decrement(x=w21) -> w22
          Build Array[ConcatenateInputs=True](s3, w22) -> w8
        }
      }
      Is Empty Array(array=w8) -> w23
      Logical Or(w20, w23) -> w6
      w7 = s2
    }
    frame True {
      w6 = TRUE
      w7 = default
      w8 = default
    }
  }
  $packet_start_loc <- w7
  $"Packet Detection Error?" <- w6
  $packet_end_loc <- w8
