vi "sub_Format Rx Data.gvi"   [LabVIEW NXG]
inputs:
  "Output Packet Array": i32[][]
outputs:
  "Received Message": string
diagram:
  Array Size(array=$"Output Packet Array") -> (size(s)=w1)
  Multiply Array Elements(numeric array=w1) -> (product=w2)
  Reshape Array(inArray=$"Output Packet Array", size=w2) -> w3
  Is Not Equal To 0(x=w3) -> w4
  w5 = 8  # Bits/Byte
  Array Size(array=w4) -> (size(s)=w6)
  Quotient And Remainder(x=w6, y=w5) -> (floor(x/y)=w7)
  Reshape Array(inArray=w4, size=w7, size=w5) -> w8
  for {
    w9 = each element of w8
    Boolean Array To Number[SignExtensionMode=1](Boolean array=w9) -> (number=w11)
    append w11 to w10
  }
  To Unsigned Byte Integer(number=w10) -> w12
  Byte Array To String(unsigned byte array=w12) -> (string=w13)
  Type Cast(x=0) -> w14
  Search And Replace String(input string=w13, replace all? (F)=TRUE, replace string ("")=" ", search string=w14) -> (result string=w15)
  $"Received Message" <- w15
