vi "sub_NoiseEst_And_Chop_Shell.gvi"   [LabVIEW NXG]
inputs:
  "data": cluster{"t0": f64, "dt": f64, "Y": c128[]}
  "Enable": bool = TRUE
  "Use MathScript?": bool
outputs:
  "Delay signal (for plotting use only)": c128[]
  "Output Packets": cluster{"Packets": c128[][], "Enable?": bool}
  "Signal & Noise Power": cluster{"signal_power": f64, "noise_power": f64}
panel indicators:
  "Graph": f64[][]
diagram:
  case ($Enable) {
    frame False, Default {
      w1 = $Enable
      w2 = default
      w3 = default
      w4 = default
    }
    frame True {
      Property Node(instance in=$data) -> ("Y"=w5)
      call "subDCOffset.gvi"(Input signal samples=w5) -> (Output signal samples=w3)
      call "sub_est_noise_power - G1.gvi"(Input Complex Samples=w3, Bin Size=5, Use MathScript?=$"Use MathScript?") -> (noise_power=w6, Energy Threshold=w7, noise_estimation_error ?=w8, signal_power=w9)
      call "sub_Chop_Packet.gvi"(Input Complex Samples=w3, Energy Threshold=w7) -> (packet_arr=w2, Packet Detection Error?=w10)
      Logical Or[output inverted](w10, w8) -> w1
      w11 = cluster{"signal_power": f64, "noise_power": f64} {all zero or empty}
      Property Node(instance in=w11, "noise_power"=w6, "signal_power"=w9) -> (instance out=w4)
    }
  }
  $"Delay signal (for plotting use only)" <- w3
  Absolute Value(x=w2) -> w12
  $Graph <- w12
  w13 = cluster{"Packets": c128[][], "Enable?": bool} {"Packets"=[], "Enable?"=TRUE}
  Property Node(instance in=w13, "Packets"=w2, "Enable?"=w1) -> (instance out=w14)
  $"Output Packets" <- w14
  $"Signal & Noise Power" <- w4
