vi "sub_Resamp_Demod_Shell.gvi"   [LabVIEW NXG]
inputs:
  "Input Packets": cluster{"Packets": c128[][], "Enable?": bool}
  "PSK Init Parameters": T3
  "Rx dt": f64
outputs:
  "Output Bitstream": cluster{"bit stream": i8[][], "Enable?": bool}
  "recovered complex waveform": cluster{"t0": f64, "dt": f64, "Y": c128[]}
  "Sync Found?": bool
panel controls:
  "error in (no error)": error
panel indicators:
  "error out": error
types:
  T1 = cluster{"samples per symbol (16)": i32, "symbol map": c128[], "differential PSK": enum{"disable", "enable"}, "PSK type": u16}
  T2 = cluster{"expected sync location (symbols)": i32, "sync sequence": c128[], "sync location uncertainty (symbols)": i32, "sync indent (symbols)": i32}
  T3 = cluster{"PSK system parameters": T1, "pulse shaping filter coefficients": f64[], "matched filter coefficients": f64[], "synchronization parameters": T2, "Sync Bits": i8[]}
diagram:
  w1 = $"error in (no error)"
  Property Node(instance in=$"Input Packets") -> ("Enable?"=w2, "Packets"=w3)
  case (w1) {
    frame No Error {
      Property Node(instance in=$"PSK Init Parameters") -> ("PSK system parameters"=w8, "matched filter coefficients"=w9, "synchronization parameters"=w10, "pulse shaping filter coefficients"=w11)
      case (w2) {
        frame False, Default {
          w4 = w1
          w12 = i8[][] []
          w6 = FALSE
          w13 = cluster{"t0": f64, "dt": f64, "Y": c128[]}[] []
        }
        frame True {
          w14 = cluster{"t0": f64, "dt": f64, "Y": c128[]} {"t0"=0, "dt"=1, "Y"=[]}
          for {
            w15 = each element of w3
            Property Node(instance in=w14, "Y"=w15, "dt"=$"Rx dt") -> (instance out=w16)
            call "MT Demodulate PSK.gvi"(input complex waveform=w16, PSK system parameters=w8, matched filter coefficients=w9, synchronization parameters=w10, error in=w1, pulse shaping filter coefficients=w11, reset?=TRUE) -> (recovered complex waveform=w17, output bit stream=w18, sync found index=w19, error out=w4)
            Is Greater Than 0(x=w19) -> w6
            append w18 to w12
            append w17 to w13
          }
        }
      }
      Array Index(array=w13) -> (out0[1]=w7)
      w20 = cluster{"bit stream": i8[][], "Enable?": bool} {"bit stream"=[], "Enable?"=TRUE}
      Property Node(instance in=w20, "bit stream"=w12, "Enable?"=w6) -> (instance out=w5)
    }
    frame Error {
      w21 = cluster{"t0": f64, "dt": f64, "Y": c128[]} {all zero or empty}
      w22 = cluster{"bit stream": i8[][], "Enable?": bool} {all zero or empty}
      w4 = w1
      w5 = w22
      w6 = FALSE
      w7 = w21
    }
  }
  $"recovered complex waveform" <- w7
  $"Output Bitstream" <- w5
  $"Sync Found?" <- w6
  $"error out" <- w4
