vi "sub_resample_and_demodulate.gvi"   [LabVIEW NXG]
inputs:
  "PSK Init Parameters": T3
  "error in (no error)": error
  "Rx dt": f64
  "packet_arr": c128[][]
outputs:
  "Recovered complex waveform": cluster{"t0": f64, "dt": f64, "Y": c128[]}
  "Sync Found": bool
  "output bit stream": i8[][]
  "error out": error
types:
  T1 = cluster{"samples per symbol (16)": i32, "symbol map": c128[], "differential PSK": enum{"disable", "enable"}, "PSK type": u16}
  T2 = cluster{"expected sync location (symbols)": i32, "sync sequence": c128[], "sync location uncertainty (symbols)": i32, "sync indent (symbols)": i32}
  T3 = cluster{"PSK system parameters": T1, "pulse shaping filter coefficients": f64[], "matched filter coefficients": f64[], "synchronization parameters": T2, "Sync Bits": i8[]}
diagram:
  case ($"error in (no error)") {
    frame No Error {
      Property Node(instance in=$"PSK Init Parameters") -> ("PSK system parameters"=w2, "matched filter coefficients"=w3, "synchronization parameters"=w4, "pulse shaping filter coefficients"=w5)
      w6 = cluster{"t0": f64, "dt": f64, "Y": c128[]} {"t0"=0, "dt"=1, "Y"=[]}
      for {
        w7 = each element of $packet_arr
        Property Node(instance in=w6, "Y"=w7, "dt"=$"Rx dt") -> (instance out=w9)
        call "MT Demodulate PSK.gvi"(input complex waveform=w9, PSK system parameters=w2, matched filter coefficients=w3, synchronization parameters=w4, error in=$"error in (no error)", pulse shaping filter coefficients=w5, reset?=TRUE) -> (recovered complex waveform=w10, output bit stream=w11, sync found index=w12, error out=w1)
        Is Greater Than 0(x=w12) -> w13
        append w11 to w8
      }
      $"Recovered complex waveform" <- w10
      $"output bit stream" <- w8
      $"Sync Found" <- w13
    }
    frame Error {
      w1 = $"error in (no error)"
    }
  }
  $"error out" <- w1
