vi "HamCodeInterleav.gvi"   [LabVIEW NXG]
panel controls:
  "stop": bool
  "Noise probability %": f64
  "milliseconds to wait": u32
panel indicators:
  "8 sample Hamming Decoded": f64[][]
  "Transmission error": bool[][]
  "8 sample": f64[][]
  "Noise deinterleaved": bool[][]
diagram:
  while {
    # Block of 8*7 bits to interleave
    for (N = 8) {
      # Generating 4 bits blocks
      for (N = 4) {
        Random Number() -> (number (0 to 1)=w4)
        Is Greater(x=w4, y=0.5) -> w5
        Select(s=w5, t=1, f=0) -> w6
        append w6 to w3
      }
      # Hamming (7,4) coding
      Math Node("in"=w3) -> ("out"=w7)
      ~~~
      out=zeros(1,7);

          for i=0:3
              out(i+1) = in(i+1);
          end

          out(5) = mod ( in(1) + in(2) + in(4 ) , 2 );
          out(6) = mod ( in(1) + in(3) + in(4) , 2 );
          out(7) = mod ( in(2) + in(3) + in(4) , 2 );

      ~~~
      append w7 to w1
      append w3 to w2
    }
    $"8 sample" <- w2
    Initialize Array(element=2, size=56) -> w8
    # Noise generator
    for (N = 56) {
      Random Number() -> (number (0 to 1)=w10)
      Divide(x=$"Noise probability %", y=100) -> w11
      Subtract(x=1, y=w11) -> w12
      Is Greater(x=w10, y=w12) -> w13
      Select(s=w13, t=1, f=0) -> w14
      append w14 to w9
    }
    # Interleaving
    Math Node("in"=w1, "n"=8, "l"=7) -> ("out"=w15)
    ~~~
        out = zeros(n*l,1);
        for i=1:n
            for j=1:l
                out(i+n*(j-1))=in(i,j);
            end
        end
    ~~~
    Reshape Array(inArray=w15, size=56) -> w16
    Add(w16, w9) -> w17
    # Adding noise
    # to the channel
    Quotient And Remainder(x=w17, y=w8) -> (x-y*floor(x/y)=w18)
    # Deinterleaving
    Math Node("in"=w18, "n"=8, "l"=7) -> ("out"=w19)
    ~~~
        out = zeros(n,l);
        for i=1:n
            for j=1:l
                out(i,j)=in(i+n*(j-1));
            end
        end
    ~~~
    # Hamming decoding
    for (N = 8) (iteration -> i1) {
      Array Index(array=w19) -> (out0[i1, _]=w21)
      Math Node("in"=w21) -> ("out"=w22)
      ~~~
          out=zeros(1,4);

          errors=[0,0,0];
          if ( not ( mod ( in(1) + in(2) + in(4) + in(5) , 2 ) == 0 ))
              errors(1)=1;
          end
          if ( not ( mod ( in(1) + in(3) + in(4) + in(6) , 2 ) == 0 ))
              errors(2)=1;
          end
          if ( not ( mod ( in(2) + in(3) + in(4) + in(7) , 2 ) == 0 ))
              errors(3)=1;
          end



          errorFlag=false;

          if sum(errors)==1
              errorFlag=true;
          end
          if sum(errors)==2
              if errors(1)==1&&errors(2)==1
                  in(1)=1-in(1);
              end
              if errors(1)==1&&errors(3)==1
                  in(2)=1-in(2);
              end
              if errors(2)==1&&errors(3)==1
                  in(3)=1-in(3);
              end
          end
          if sum(errors)==3
              in(4)=1-in(4);
          end

          for i=1:4
              out(i)=in(i);
          end
      ~~~
      append w22 to w20
    }
    # Comparing sent and receive messages
    Is Not Equal(x=w2, y=w20) -> w23
    $"Transmission error" <- w23
    $"8 sample Hamming Decoded" <- w20
    Math Node("in"=w9, "n"=8, "l"=7) -> ("out"=w24)
    ~~~
        out = zeros(n,l);
        for i=1:n
            for j=1:l
                out(i,j)=in(i+n*(j-1));
            end
        end
    ~~~
    Is Equal(x=w24, y=1) -> w25
    $"Noise deinterleaved" <- w25
    Wait Ms(msToWait=$"milliseconds to wait")
    stop if $stop
  }
