vi "HammingCodeInterleaveNoiseDemonstration.gvi"   [LabVIEW NXG]
panel controls:
  "stop": bool
  "Noise probability %": f64 = 5
  "milliseconds to wait": u32 = 500
panel indicators:
  "8 sample Hamming Decoded": f64[][]
  "Transmission error": bool[][]
  "8 sample": f64[][]
  "Noise deinterleaved": bool[][]
diagram:
  while {
    # Block of 8*7 bits to interleave
    for (N = 8) {
      # Generating 4 bits blocks
      for (N = 4) {
        Random Number() -> (number (0 to 1)=w4)
        Is Greater(x=w4, y=0.5) -> w5
        Select(s=w5, t=1, f=0) -> w6
        append w6 to w3
      }
      # Hamming (7,4) coding
      call "HammingCode.gvi"(Variable: in=w3) -> (Variable: out=w7)
      append w7 to w1
      append w3 to w2
    }
    $"8 sample" <- w2
    Initialize Array(element=2, size=56) -> w8
    # Noise generator
    for (N = 56) {
      Random Number() -> (number (0 to 1)=w10)
      Divide(x=$"Noise probability %", y=100) -> w11
      Subtract(x=1, y=w11) -> w12
      Is Greater(x=w10, y=w12) -> w13
      Select(s=w13, t=1, f=0) -> w14
      append w14 to w9
    }
    # Interleaving
    call "Interleaving.gvi"(Variable: in=w1, Variable: n=8, Variable: l=7) -> (Variable: out=w15)
    Reshape Array(inArray=w15, size=56) -> w16
    Add(w16, w9) -> w17
    # Adding noise
    # to the channel
    Quotient And Remainder(x=w17, y=w8) -> (x-y*floor(x/y)=w18)
    # Deinterleaving
    call "Deinterleaving.gvi"(Variable: in=w18, Variable: n=8, Variable: l=7) -> (Variable: out=w19)
    # Hamming decoding
    for (N = 8) (iteration -> i1) {
      Array Index(array=w19) -> (out0[i1, _]=w21)
      call "HammingDecode.gvi"(Variable: in=w21) -> (Variable: out=w22)
      append w22 to w20
    }
    # Comparing sent and receive messages
    Is Not Equal(x=w2, y=w20) -> w23
    $"Transmission error" <- w23
    $"8 sample Hamming Decoded" <- w20
    call "Deinterleaving.gvi"(Variable: in=w9, Variable: n=8, Variable: l=7) -> (Variable: out=w24)
    # Noise display
    Is Equal(x=w24, y=1) -> w25
    $"Noise deinterleaved" <- w25
    Wait Ms(msToWait=$"milliseconds to wait")
    stop if $stop
  }
