vi "Deinterleaver.gvi"   [LabVIEW NXG]
inputs:
  "input": f64[]
  "lengthInterleaver": f64
  "tolerance": f64
outputs:
  "queueOut": Queue<f64[]>
  "queueErrorOut": error
  "foundSynchro": bool
panel indicators:
  "inputPacket": f64[]
  "inputIndex": u32
  "inputPacketSize": i32
  "inputSize": i32
  "outSize": i32[]
  "expectedIndex": f64
  "realityCheck": f64
  "nbDesync": f64
  "foundZero": bool
  "listIndexReceived": u32[]
diagram:
  Array Size(array=$input) -> (size(s)=w1)
  Subtract(x=w1, y=10) -> w2
  Array Subset(array=$input, index0=w2, length0=w1) -> w3
  Is Not Equal To 0(x=w3) -> w4
  Boolean Array To Number(Boolean array=w4) -> (number=w5)
  Is Equal To 0(x=w5) -> w6
  Not(x=w8) -> w7
  Logical And(w7, w6) -> w9
  Array Subset(array=$input, length0=w2) -> w10
  Logical Or(w12, w13) -> w11
  case (w11) {
    frame False, Default {
      w14 = w16
      w15 = w16
    }
    frame True {
      Initialize Array(element=0) -> w14
      w15 = w16
    }
  }
  Feedback Node(Input=w14) -> (Output=w17)
  # reSynchro
  case (w18) {
    frame False, Default {
      w12 = FALSE
      w16 = default
      w13 = TRUE
    }
    frame True {
      Build Array[ConcatenateInputs=True](w17, w10) -> w16
      Array Size(array=w16) -> (size(s)=w19)
      Array Index(array=w19) -> (out0[0]=w20)
      Is Equal(x=$lengthInterleaver, y=w20) -> w12
      Increment(x=w21) -> w22
      Quotient And Remainder(x=w22, y=$lengthInterleaver) -> (x-y*floor(x/y)=w23)
      Feedback Node(Input=w23) -> (Output=w24)
      case (w9) {
        frame False, Default {
          w21 = w24
        }
        frame True {
          w21 = 0
        }
      }
      Is Equal(x=w5, y=w21) -> w25
      Feedback Node(Input=w26) -> (Output=w27)
      case (w9) {
        frame False, Default {
          w28 = w27
        }
        frame True {
          w28 = 0
        }
      }
      case (w25) {
        frame False, Default {
          Increment(x=w28) -> w26
        }
        frame True {
          Decrement(x=w28) -> w29
          Max And Min(x=w29, y=0) -> (max(x,y)=w26: f64)
        }
      }
      # desynchronized
      $nbDesync <- w26
      $expectedIndex <- w21
      Is Greater(x=w26, y=$tolerance) -> w13
      Subtract(x=w21, y=w5) -> w30
      $realityCheck <- w30
    }
  }
  Feedback Node(Input=w13) -> (Output=w31)
  case (w8) {
    frame False, Default {
      w18 = w9
    }
    frame True {
      Not(x=w31) -> w32
      Logical And(w8, w32) -> w18
    }
  }
  Feedback Node(Initializer=FALSE, Input=w18) -> (Output=w8)
  $foundSynchro <- w8
  Array Size(array=w10) -> (size(s)=w33)
  $inputPacketSize <- w33
  Obtain Queue(element data type=f64[] [], name (unnamed)="deInterleavedCodedSample") -> (error out=w34, queue out=w35)
  case (w12) {
    frame False, Default {
      w36 = w35
      w37 = w34
    }
    frame True {
      Array Size(array=w15) -> (size(s)=w38)
      Array Index(array=w38) -> (out0[1]=w39)
      Array Index(array=w38) -> (out0[0]=w40)
      Multiply(w40, w39) -> w41
      Reshape Array(inArray=w15, size=w41) -> w42
      call "MT Block DeInterleave (Matrix).gvi"(data in=w42, number of rows=w40, number of columns=w39) -> (data out=w43)
      Reshape Array(inArray=w43, size=w40, size=w39) -> w44
      Array Size(array=w44) -> (size(s)=w45)
      $outSize <- w45
      Array Index(array=w45) -> (out0[0]=w46)
      for (N = w46) {
        w47 = each element of w44
        Enqueue Element(element=w47, error in (no error)=w34, queue=w35) -> (error out=w37, queue out=w36)
      }
    }
  }
  $queueOut <- w36
  $queueErrorOut <- w37
  $inputPacket <- w10
  $inputIndex <- w5
  $foundZero <- w9
  Feedback Node(Input=w48) -> (Output=w49)
  Build Array[ConcatenateInputs=True](w5, w49) -> w48
  $listIndexReceived <- w48
  $inputSize <- w1
