vi "Function.gvi"   [LabVIEW NXG]
panel controls:
  "stop": bool
  "number": u32
panel indicators:
  "0, 1": i16[]
  "initialized array": f64[][]
diagram:
  while {
    Number To Boolean Array(number=$number) -> (Boolean array=w1)
    Boolean To Integer(Boolean=w1) -> (0, 1=w2)
    $"0, 1" <- w2
    Initialize Array(element=0) -> w3
    $"initialized array" <- w3
    stop if $stop
  }
