vi "Interleaver.gvi"   [LabVIEW NXG]
inputs:
  "input": f64[]
  "lengthInterleaver": i32
outputs:
  "queueOut": Queue<f64[]>
  "queueErrorOut": error
panel indicators:
  "blockWaitingInterleaving": f64[][]
  "nbWaitingInterleaving": i32
diagram:
  Array Size(array=w1) -> (size(s)=w2)
  Array Index(array=w2) -> (out0[0]=w3)
  Is Equal(x=$lengthInterleaver, y=w3) -> w4
  Obtain Queue(element data type=f64[] [], name (unnamed)="InterleavedCodedSamples") -> (error out=w5, queue out=w6)
  case (w4) {
    frame False, Default {
      w7 = w1
      w8 = w6
      w9 = w5
    }
    frame True {
      Array Size(array=w1) -> (size(s)=w10)
      Array Index(array=w10) -> (out0[0]=w11)
      Array Index(array=w10) -> (out0[1]=w12)
      Multiply(w11, w12) -> w13
      Reshape Array(inArray=w1, size=w13) -> w14
      call "MT Block Interleave (Matrix).gvi"(data in=w14, number of rows=w11, number of columns=w12) -> (data out=w15)
      Reshape Array(inArray=w15, size=w11, size=w12) -> w16
      Array Size(array=w16) -> (size(s)=w17)
      Array Index(array=w17) -> (out0[0]=w18)
      for (N = w18) (iteration -> i1) {
        w19 = each element of w16
        Number To Boolean Array(number=i1) -> (Boolean array=w21)
        Boolean To Integer(Boolean=w21) -> (0, 1=w22)
        Array Subset(array=w22, length0=10) -> w23
        Build Array[ConcatenateInputs=True](w19, w23) -> w24
        append w24 to w20
      }
      for (N = $lengthInterleaver) {
        w25 = each element of w20
        Lossy Enqueue Element(element=w25, error in (no error)=w5, queue=w6) -> (error out=w9, queue out=w8)
      }
      Initialize Array(element=0) -> w7
    }
  }
  Feedback Node(Input=w7) -> (Output=w26)
  Build Array[ConcatenateInputs=True](w26, $input) -> w1
  $blockWaitingInterleaving <- w1
  $nbWaitingInterleaving <- w3
  $queueOut <- w8
  $queueErrorOut <- w9
