vi "ldpcDecoding.gvi"   [LabVIEW NXG]
inputs:
  "ReceivedMessage": i32[]
  "CheckMatrix": f64[][]
  "itMax": i32
  "Hposition": f64[][]
  "matscript": f64
  "correct": bool
  "optimizedSyndrom": f64
outputs:
  "MesageDecoded": i32[]
panel indicators:
  "Syndrom": f64[]
  "loop iteration": i32
  "Variable: out": i32[]
  "sizeMessage": i32
  "sizeCheckMatrix": i32[]
  "sizeSyndrom": i32
  "x - 1": f64[][]
  "res": f64[]
  "notRes": f64[]
  "error": i32
diagram:
  Array Size(array=$ReceivedMessage) -> (size(s)=w1)
  $sizeMessage <- w1
  Array Size(array=$CheckMatrix) -> (size(s)=w2)
  $sizeCheckMatrix <- w2
  Array Index(array=w2) -> (out0[1]=w3)
  Is Equal(x=w3, y=w1) -> w4
  Logical And($correct, w4) -> w5
  case (w5) {
    frame False, Default {
      w6 = $ReceivedMessage
    }
    frame True {
      s1 = $ReceivedMessage  # shift register
      while (iteration -> i1) {
        case ($optimizedSyndrom) {
          frame 0, Default {
            call "A x Vector.gvi"(A=$CheckMatrix, Vector=s1) -> (A x Vector=w8, error=w9)
            Quotient And Remainder(x=w8, y=2) -> (x-y*floor(x/y)=w7)
            $error <- w9
          }
          frame 1 {
            # Hposition
            # H
            # messageCoded
            Decrement(x=$Hposition) -> w10
            Array Size(array=w10) -> (size(s)=w11)
            Array Index(array=w11) -> (out0[0]=w12)
            Initialize Array(element=0, size=w12) -> w13
            for (N = w12) {
              w14 = each element of w13
              w15 = each element of w10
              s2 = 0  # shift register
              s3 = w14  # shift register
              while {
                Array Index(array=w15) -> (out0[s2]=w17)
                Array Index(array=s1) -> (out0[w17]=w18)
                Add(w18, s3) -> w19
                Increment(x=s2) -> w20
                Array Size(array=w15) -> (size(s)=w21)
                Is Less(x=w21, y=w20) -> w22
                Array Index(array=w15) -> (out0[w20]=w23)
                Is Less Than 0(x=w23) -> w24
                Logical Or(w22, w24) -> w25
                next s2 = w20
                next s3 = w19
                stop if w25
              }
              append s3 to w16
            }
            Quotient And Remainder(x=w16, y=2) -> (x-y*floor(x/y)=w7)
          }
          frame 2 {
            Array Size(array=$Hposition) -> (size(s)=w26)
            Array Index(array=w26) -> (out0[0]=w27)
            Initialize Array(element=0, size=w27) -> w7
          }
        }
        Array Size(array=w7) -> (size(s)=w28)
        $sizeSyndrom <- w28
        $Syndrom <- w7
        # syndrom
        # H
        # messageCoded
        # Hposition
        # sizeMessage
        case ($matscript) {
          frame 1 {
            Decrement(x=$Hposition) -> w30
            Initialize Array(element=0, size=w1) -> w31
            Initialize Array(element=0, size=w1) -> w32
            Array Size(array=w30) -> (size(s)=w33)
            Array Index(array=w33) -> (out0[0]=w34)
            s4 = w32  # shift register
            s5 = w31  # shift register
            for (N = w34) {
              w35 = each element of w30
              w36 = each element of w7
              Is Equal To 0(x=w36) -> w37
              # For check from 1 to m
              s6 = 0  # shift register
              s7 = s5  # shift register
              s8 = s4  # shift register
              while {
                Array Index(array=w35) -> (out0[s6]=w38)
                case (w37) {
                  frame False, Default {
                    Array Index(array=s8) -> (out0[w38]=w41)
                    Increment(x=w41) -> w42
                    Insert Into Array(inArray=s8, index0=w38, new=w42) -> w40
                    w39 = s7
                  }
                  frame True {
                    Array Index(array=s7) -> (out0[w38]=w43)
                    Increment(x=w43) -> w44
                    Insert Into Array(inArray=s7, index0=w38, new=w44) -> w39
                    w40 = s8
                  }
                }
                Increment(x=s6) -> w45
                Array Size(array=w35) -> (size(s)=w46)
                Is Less(x=w46, y=w45) -> w47
                Array Index(array=w35) -> (out0[w45]=w48)
                Is Less Than 0(x=w48) -> w49
                Logical Or(w47, w49) -> w50
                next s6 = w45
                next s7 = w39
                next s8 = w40
                stop if w50
              }
              next s4 = s8
              next s5 = s7
            }
            for (N = w1) {
              w51 = each element of s5
              w52 = each element of s4
              w53 = each element of s1
              # For bit from 1 to n
              Is Greater(x=w51, y=w52) -> w54
              case (w54) {
                frame False, Default {
                  Subtract(x=1, y=w53) -> w55
                }
                frame True {
                  w55 = w53
                }
              }
              append w55 to w29
            }
            $"x - 1" <- w30
            $res <- s5
            $notRes <- s4
          }
          frame 0, Default {
            Math Node("syndrom"=w7, "H"=$CheckMatrix, "in"=s1, "Hposition"=$Hposition) -> ("out"=w29)
            ~~~
            m=size(H,1);    % Number of checks
            n=size(H,2);    % Number of bits in codeword
            k=n-m;


            % Find the checks that are not respected
            syndrom;

            % For each bit count the number of checks respected and not respected
            res=zeros(1,n);
            notRes=zeros(1,n);

            for check=1:m
                count=1
                bit=Hposition(check,count)
                while and(bit~=0, count<=n)
                    if syndrom(1, check)==1
                        notRes(bit)=notRes(bit)+1;
                    else
                        res(bit)=res(bit)+1;
                    end
                    count=count+1;
                    if count<=n
                        bit=Hposition(check,count);
                    end
                end
            end

            % if more not respected flip the bit
            for bit=1:n
                if notRes(bit)>res(bit)
                    in(bit)=mod(in(bit)+1,2);
                end
            end

            out=in;
            ~~~
          }
          frame 2 {
            w29 = s1
          }
        }
        $"Variable: out" <- w29
        $"loop iteration" <- i1
        Add Array Elements(numeric array=w7) -> (sum=w56)
        Is Equal To 0(x=w56) -> w57
        Is Greater(x=i1, y=$itMax) -> w58
        Logical Or(w58, w57) -> w59
        next s1 = w29
        stop if w59
      }
      w6 = s1
    }
  }
  Array Index(array=w2) -> (out0[0]=w60)
  Array Index(array=w2) -> (out0[1]=w61)
  Subtract(x=w61, y=w60) -> w62
  Array Subset(array=w6, index0=w60, length0=w62) -> w63
  $MesageDecoded <- w63
