vi "ldpcDenseCoding.gvi"   [LabVIEW NXG]
inputs:
  "Message": f64[]
  "generatorMatrix": f64[][]
outputs:
  "EncodedMessage": f64[]
panel indicators:
  "seedSize": i32[]
  "genSize": i32[]
  "messageSize": i32
  "encSize": i32
  "error": i32
diagram:
  Array Size(array=$generatorMatrix) -> (size(s)=w1)
  $seedSize <- w1
  Array Size(array=$generatorMatrix) -> (size(s)=w2)
  Array Index(array=w2) -> (out0[0]=w3)
  call "Create Special Real Matrix.gvi"(matrix size=w3) -> (special matrix=w4)
  Build Array[ConcatenateInputs=True]($generatorMatrix, w4) -> w5
  Array Size(array=w5) -> (size(s)=w6)
  $genSize <- w6
  call "A x Vector.gvi"(A=w5, Vector=$Message) -> (A x Vector=w7, error=w8)
  Quotient And Remainder(x=w7, y=2) -> (x-y*floor(x/y)=w9)
  Array Size(array=w9) -> (size(s)=w10)
  $encSize <- w10
  $EncodedMessage <- w9
  $error <- w8
  Array Size(array=$Message) -> (size(s)=w11)
  $messageSize <- w11
