vi "ldpcMatrixTest.gvi"   [LabVIEW NXG]
panel controls:
  "CheckMatrixLocation": path
  "GeneratorMatrixLocation": path
panel indicators:
  "CheckMatrix": f64[][]
  "GenMatrix": f64[][]
  "GenMatrixize": i32[]
  "CheckMatrixSize": i32[]
  "HxG": f64[][]
  "ProductSize": i32[]
  "GenMatrix2": f64[][]
  "GenMatrixize_2": i32[]
  "IdentitySize": i32[]
diagram:
  call "Read from Spreadsheet File (DBL).gvi"(file path=$CheckMatrixLocation, format="%.3f", delimiter=",") -> (all rows=w1)
  $CheckMatrix <- w1
  Array Size(array=w1) -> (size(s)=w2)
  $CheckMatrixSize <- w2
  call "Read from Spreadsheet File (DBL).gvi"(file path=$GeneratorMatrixLocation, format="%.3f", delimiter=",") -> (all rows=w3)
  call "Real Transpose Matrix.gvi"(input matrix=w3) -> (matrix transpose=w4)
  Array Size(array=w3) -> (size(s)=w5)
  Array Index(array=w5) -> (out0[0]=w6)
  call "Create Special Real Matrix.gvi"(matrix type=0, matrix size=w6) -> (special matrix=w7)
  call "Real Transpose Matrix.gvi"(input matrix=w7) -> (matrix transpose=w8)
  Build Array[ConcatenateInputs=True](w8, w4) -> w9
  call "Real Transpose Matrix.gvi"(input matrix=w9) -> (matrix transpose=w10)
  call "Real Transpose Matrix.gvi"(input matrix=w10) -> (matrix transpose=w11)
  call "Real A x B.gvi"(A=w1, B=w11) -> (A x B=w12)
  Quotient And Remainder(x=w12, y=2) -> (x-y*floor(x/y)=w13)
  $HxG <- w13
  $GenMatrix <- w3
  Array Size(array=w13) -> (size(s)=w14)
  $ProductSize <- w14
  $GenMatrix2 <- w10
  Array Size(array=w10) -> (size(s)=w15)
  $GenMatrixize_2 <- w15
  $GenMatrixize <- w5
  Array Size(array=w7) -> (size(s)=w16)
  $IdentitySize <- w16
