vi "ldpcSparseEncoding.gvi"   [LabVIEW NXG]
panel controls:
  "Umatrix": path
  "Lmatrix": path
  "Message": f64[]
  "Bmatrix": path
panel indicators:
  "y": f64[]
  "z": f64[]
diagram:
  call "Read from Spreadsheet File (DBL).gvi"(file path=$Bmatrix, format="%.3f", delimiter=",") -> (all rows=w1)
  call "A x Vector.gvi"(A=w1, Vector=$Message) -> (A x Vector=w2)
  $z <- w2
  call "Read from Spreadsheet File (DBL).gvi"(file path=$Lmatrix, format="%.3f", delimiter=",") -> (all rows=w3)
  call "Solve Linear Equations (single right hand).gvi"(input matrix=w3, known vector=w2) -> (solution vector=w4)
  $y <- w4
  call "Read from Spreadsheet File (DBL).gvi"(file path=$Umatrix, format="%.3f", delimiter=",") -> (all rows=w5)
  call "Solve Linear Equations (single right hand).gvi"(input matrix=w5, known vector=w4)
