vi "ldpcTest.gvi"   [LabVIEW NXG]
panel controls:
  "CheckMatrixLocation": path
  "GeneratorMatrixLocation": path
  "stop": bool
  "messageLength": i32
  "numberNoise": i32
  "correct": bool
  "itMax": i32
  "coding": bool
  "matscript": f64
  "optimizedSyndrom": f64
panel indicators:
  "MesageDecoded": i32[]
  "matrixProduct": f64
  "Gsize": i32[]
  "Hsize": i32[]
  "sizeCodedMessage": i32
  "sizeNoisyMessage": i32
  "errorDecoding": i16
  "sumNoisyMessage": f64
  "loop iteration": i32
  "Hposi": f64[][]
  "message": f64[]
  "EncodedMessage": f64[]
  "receivedMessage": f64[]
  "GseedSize": i32[]
diagram:
  call "Read from Spreadsheet File (DBL).gvi"(file path=$GeneratorMatrixLocation, format="%.3f", delimiter=",") -> (all rows=w1)
  call "Read from Spreadsheet File (DBL).gvi"(file path=$CheckMatrixLocation, format="%.3f", delimiter=",") -> (all rows=w2)
  call "extractCheckposition.gvi"(Numeric Array Input=w2) -> (Numeric Array Output=w3)
  s1 = uninitialised  # shift register
  while (iteration -> i1) {
    Initialize Array(element=0, size=$messageLength, size=0) -> w4
    Reshape Array(inArray=w4, size=$messageLength) -> w5
    $message <- w5
    case ($coding) {
      frame False, Default {
        w6 = s1
      }
      frame True {
        call "ldpcDenseCoding.gvi"(Message=w5, generatorMatrix=w1) -> (EncodedMessage=w6)
      }
    }
    Build Array[ConcatenateInputs=True](w5, w5) -> w7
    Initialize Array(element=1, size=$numberNoise, size=1) -> w8
    Reshape Array(inArray=w8, size=$numberNoise) -> w9
    Replace Array Subset(inArray=w7, 0, w9) -> w10
    Add(w10, w6) -> w11
    Quotient And Remainder(x=w11, y=2) -> (x-y*floor(x/y)=w12)
    call "ldpcDecoding.gvi"(ReceivedMessage=w12, CheckMatrix=w2, itMax=$itMax, Hposition=w3, matscript=$matscript, correct=$correct, optimizedSyndrom=$optimizedSyndrom) -> (MesageDecoded=w13)
    Is Not Equal(x=w5, y=w13) -> w14
    Boolean To Integer(Boolean=w14) -> (0, 1=w15)
    Add Array Elements(numeric array=w15) -> (sum=w16)
    $errorDecoding <- w16
    Array Size(array=w12) -> (size(s)=w17)
    $sizeNoisyMessage <- w17
    Add Array Elements(numeric array=w12) -> (sum=w18)
    $sumNoisyMessage <- w18
    $MesageDecoded <- w13
    $EncodedMessage <- w6
    $receivedMessage <- w12
    Array Size(array=w2) -> (size(s)=w19)
    $Hsize <- w19
    Array Size(array=w6) -> (size(s)=w20)
    $sizeCodedMessage <- w20
    $"loop iteration" <- i1
    next s1 = w6
    stop if $stop
  }
  Array Size(array=w1) -> (size(s)=w21)
  Array Index(array=w21) -> (out0[1]=w22)
  call "Create Special Real Matrix.gvi"(matrix size=w22) -> (special matrix=w23)
  Build Array[ConcatenateInputs=True](w1, w23) -> w24
  Array Size(array=w24) -> (size(s)=w25)
  $Gsize <- w25
  call "Real A x B.gvi"(A=w2, B=w24) -> (A x B=w26)
  Quotient And Remainder(x=w26, y=2) -> (x-y*floor(x/y)=w27)
  Add Array Elements(numeric array=w27) -> (sum=w28)
  $matrixProduct <- w28
  $Hposi <- w3
  Array Size(array=w1) -> (size(s)=w29)
  $GseedSize <- w29
