vi "testInterleaver.gvi"   [LabVIEW NXG]
panel controls:
  "stop": bool
  "input": f64[]
  "lengthInterleaver": i32
  "tolerance": f64
panel indicators:
  "foundSynchro": bool
  "out": f64[][]
  "number elements in middle queue": i32
  "number elements in finale queue": i32
  "middle": f64[][]
  "sizeMiddle": i32[]
  "sizeOut": i32[]
diagram:
  while {
    Wait Ms(msToWait=1000)
    call "Interleaver.gvi"(input=$input, lengthInterleaver=$lengthInterleaver) -> (queueOut=w1, queueErrorOut=w2)
    Get Queue Status(error in (no error)=w2, queue=w1) -> (# elements in queue=w3, error out=w4, queue out=w5)
    Dequeue Element(error in (no error)=w4, queue=w5, timeout in ms (-1)=15) -> (element=w6)
    Feedback Node(Input=w7) -> (Output=w8)
    Build Array[ConcatenateInputs=True](w8, w6) -> w7
    $middle <- w7
    call "Deinterleaver.gvi"(input=w6, lengthInterleaver=$lengthInterleaver, tolerance=$tolerance) -> (queueOut=w9, queueErrorOut=w10, foundSynchro=w11)
    Get Queue Status(error in (no error)=w10, queue=w9) -> (# elements in queue=w12, error out=w13, queue out=w14)
    Dequeue Element(error in (no error)=w13, queue=w14, timeout in ms (-1)=15) -> (element=w15)
    Feedback Node(Input=w16) -> (Output=w17)
    Build Array[ConcatenateInputs=True](w15, w17) -> w16
    $out <- w16
    Array Size(array=w7) -> (size(s)=w18)
    $sizeMiddle <- w18
    Array Size(array=w16) -> (size(s)=w19)
    $sizeOut <- w19
    $foundSynchro <- w11
    $"number elements in middle queue" <- w3
    $"number elements in finale queue" <- w12
    stop if $stop
  }
