vi "uLawCode.gvi"   [LabVIEW NXG]
inputs:
  "x": f64
  "mu": f64
outputs:
  "y": f64
diagram:
  Sign(number=$x) -> (-1, 0, 1=w1)
  Absolute Value(x=$x) -> w2
  Multiply(w2, $mu) -> w3
  Natural Logarithm 2(x=w3) -> w4
  Natural Logarithm 2(x=$mu) -> w5
  Divide(x=w4, y=w5) -> w6
  Multiply(w1, w6) -> w7
  $y <- w7
