vi "uLawDecode8to16bits.gvi"   [LabVIEW NXG]
inputs:
  "x": f64
outputs:
  "y": u16
diagram:
  To Unsigned Byte Integer(number=$x) -> w1
  # Input x should be between 0 and 255 (2^8 -1)
  # Output y will be betzeen 0 and 25535 (2^16 -1)
  Divide(x=w1, y=255) -> w2
  call "uLawDecode.gvi"(x=w2, mu=255) -> (y=w3)
  Multiply(w3, 25535) -> w4
  To Unsigned Word Integer(number=w4) -> w5
  $y <- w5
