vi "uLawTest.gvi"   [LabVIEW NXG]
panel controls:
  "input": f64
  "mu": f64
  "stop": bool
  "x": f64
  "stop_2": bool
  "X_2": f64[]
  "stop_3": bool
panel indicators:
  "coded": f64
  "decoded": f64
  "coded8bits": u8
  "y": u16
  "middle": u8
  "MIDDLE_2": u8[]
  "Y_2": u16[]
diagram:
  while {
    Divide(x=$input, y=25535) -> w1
    call "uLawCode.gvi"(x=w1, mu=$mu) -> (y=w2)
    $coded <- w2
    Multiply(255, w2) -> w3
    To Unsigned Byte Integer(number=w3) -> w4
    $coded8bits <- w4
    Divide(x=w4, y=255) -> w5
    call "uLawDecode.gvi"(x=w5, mu=$mu) -> (y=w6)
    Multiply(25535, w6) -> w7
    $decoded <- w7
    stop if $stop
  }
  while {
    call "uLawCode16to8bits.gvi"(x=$x) -> (y=w8)
    call "uLawDecode8to16bits.gvi"(x=w8) -> (y=w9)
    $y <- w9
    $middle <- w8
    stop if $stop_2
  }
  while {
    call "uLawCodeArray16to8.gvi"(X=$X_2) -> (Y=w10)
    call "uLawDecodeArray8to16bits.gvi"(X=w10) -> (Y=w11)
    $Y_2 <- w11
    $MIDDLE_2 <- w10
    stop if $stop_3
  }
