vi "Function.gvi"   [LabVIEW NXG]
inputs:
  "16-bit integer": i16[][]
  "Packet Message Length (bits)": i32 = 128
outputs:
  "File Length (bits)": i32
  "appended array": i16[]
  "Number of Packets": i32
  "32-bit integer": i32
  "element": i16[]
diagram:
  Array Size(array=$"16-bit integer") -> (size(s)=w1)
  Multiply Array Elements(numeric array=w1) -> (product=w2)
  Reshape Array(inArray=$"16-bit integer", size=w2) -> w3
  Array Size(array=w3) -> (size(s)=w4)
  $"File Length (bits)" <- w4
  Divide(x=w4, y=$"Packet Message Length (bits)") -> w5
  Round Toward Positive Infinity(x=w5) -> w6
  Multiply(w6, $"Packet Message Length (bits)") -> w7
  Subtract(x=w7, y=w4) -> w8
  To Long Integer(number=w8) -> w9
  Initialize Array(element=0, size=w9) -> w10
  Build Array[ConcatenateInputs=True](w3, w10) -> w11
  $"appended array" <- w11
  To Long Integer(number=w6) -> w12
  $"Number of Packets" <- w12
  $"32-bit integer" <- w9
  $element <- w11
