vi "Rx_main.gvi"   [LabVIEW NXG]
panel controls:
  "IQ rate": f64 = 500000
  "carrier frequency": f64 = 2449500000
  "gain": f64 = 20
  "PSK type": enum{"normal", "shifted", "offset"} = "normal"
  "samples per symbol": i32 = 16
  "M-PSK": i32 = 4
  "modulation type": T1 = "PSK"
  "pulse shaping filter": T2 = "Root Raised Cos"
  "filter parameter": f64 = 0.5
  "stopFetchingLoop": bool
  "packet_size_with_padding": f64 = 10624
  "wanted_sync_index": f64 = 60
  "correction": f64 = 0.4
  "multiple": f64 = 100
  "soundSamplesPerPacket": i32 = 128
  "bitsPerSample": i32 = 8
  "uLaw": bool
  "CheckMatrixLocation": path
  "LDPC": bool
  "LDPCitMax": i32
  "codingRate": f64 = 2
  "interleving": bool
  "lengthInterleaver": f64
  "toleranceInterleaver": f64
  "reset": bool
  "FastOrSlowDemod": enum{"Slow", "Fast"} = "Fast"
  "Use MathScript?": bool
panel indicators:
  "Demodulated IQ Graph": T3[]
  "SoundOutput": waveform<f64>[]
  "loop iteration": i32
  "InterleaverfoundSynchro": bool
  "deviationFrom010101...": i16[]
  "sumDeviationFrom010101...": u64
  "errorRate": f64
  "nbBitReceived": i32
  "nonNullDeviationsFrom101010...": i16[]
  "sync index": f64
  "signal_power": f64
  "noise_power": f64
  "Energy Threshold": f64
  "SNR_dB": f64
  "iterPerSecond": f64
  "feedbackIterValue": i32
  "absolute value": f64
  "logical AND": bool
types:
  T1 = enum{"FSK", "PSK", "QAM", "MSK", "PAM", "ASK", "CPM"}
  T2 = enum{"none", "Raised Cosine", "Root Raised Cos", "Gaussian"}
  T3 = cluster{"constellation": f64[], "oversampled data": f64[]}
  T4 = cluster{"sample rate": f64, "number of channels": i32, "bits per sample": i32}
  T5 = cluster{"samples per symbol (16)": i32, "symbol map": c128[], "differential PSK": enum{"disable", "enable"}, "PSK type": enum{"normal", "shifted", "offset"}}
  T6 = cluster{"expected sync location (symbols)": i32, "sync sequence": c128[], "sync location uncertainty (symbols)": i32, "sync indent (symbols)": i32}
  T7 = cluster{"psk_system_params": T5, "pulse_shaping_filter_coeffs": f64[], "matched_filter_coeffs": f64[], "sync_params": T6, "sync_seq_bits": i8[]}
diagram:
  w1 = $wanted_sync_index
  w2 = $packet_size_with_padding
  w3 = $interleving
  w4 = $LDPC
  w5 = $soundSamplesPerPacket
  w6 = $bitsPerSample
  w7 = $correction
  w8 = $multiple
  w9 = T4 {"sample rate"=6000, "number of channels"=1, "bits per sample"=8}
  w10 = $FastOrSlowDemod
  call "niUSRP Open Rx Session.gvi"(Device names="192.168.10.2") -> (Error Out=w11, Session handle=w12)
  call "niUSRP Configure Signal.gvi"(session handle=w12, IQ rate=$"IQ rate", carrier frequency=$"carrier frequency", gain=$gain, error in (no error)=w11, active antenna="RX1") -> (session handle out=w13, Error Out=w14)
  call "niUSRP Initiate.gvi"(session handle=w13, error in (no error)=w14) -> (session handle out=w15, Error Out=w16)
  call "initPSK.gvi"(PSK type=$"PSK type", samples per symbol=$"samples per symbol", M-PSK=$"M-PSK", modulation type=$"modulation type", pulse shaping filter=$"pulse shaping filter", filter parameter=$"filter parameter", PSK_params_in=T7 {all zero or empty}) -> (PSK_params_out=w17)
  call "Sound Output Configure.gvi"(device ID=0, sound format=w9, number of samples per channel=8000) -> (task ID=w18, error out=w19)
  call "Sound Output Start.gvi"(task ID=w18, error in=w19) -> (task ID out=w20, error out=w21)
  w22 = cluster{"t0": f64, "dt": f64, "Y": c128[]} {all zero or empty}
  w23 = $"Use MathScript?"
  w24 = $lengthInterleaver
  w25 = $toleranceInterleaver
  w26 = $LDPCitMax
  call "Read from Spreadsheet File (DBL).gvi"(file path=$CheckMatrixLocation, format="%.3f", delimiter=",") -> (all rows=w27)
  s1 = w22  # shift register
  s2 = uninitialised  # shift register
  s3 = uninitialised  # shift register
  while (iteration -> i1) {
    Is Greater Than 0(x=i1) -> w28
    case (w10) {
      frame "Slow", Default {
        call "slowDemodBlock.gvi"(data=s1, PSK_params_in=w17) -> (output bit stream=w30, recovered complex waveform=w31, sync found index=w29)
        call "MT Format Constellation.gvi"(waveform=w31) -> (constellation graph=w32)
        $"Demodulated IQ Graph" <- w32
      }
      frame "Fast" {
        call "fastDemodBlock.gvi"(data=s1, PSK_params_in=w17) -> (output bit stream=w30, sync found index=w29)
      }
    }
    case (w28) {
      frame False, Default {
        w33 = w2
        w34 = w15
        w35 = w16
      }
      frame True {
        Not(x=w28) -> w36
        call "adjustSamplesToSync.gvi"(wanted_sync_index=w1, current_sync_index=w29, packet_size_with_padding=w2, first_interation?=w36, sync_location_last_iteration=s2, samples_last_interation=s3) -> (new_NumOfSamples=w33)
        w34 = w15
        w35 = w16
      }
    }
    To Unsigned Quad Integer(number=w33) -> w37
    call "niUSRP Fetch Rx Data (CDB Cluster).gvi"(session handle=w34, number of samples=w37, error in (no error)=w35) -> (session handle out=w38, data=w39, Error Out=w40)
    call "SignalAndNoiseEstimate.gvi"(Use MathScript?=w23, data=w39) -> (signal_power=w41, noise_power=w42, Energy Threshold=w43, SNR_dB=w44)
    $signal_power <- w41
    call "calcPacketsPerSecond.gvi"(sync index=w29, wanted sync index=w1, loop iteration=i1) -> (iterPerSecond=w45, feedbackIterValue=w46, absolute value=w47, logical AND=w48)
    $"logical AND" <- w48
    $noise_power <- w42
    $"Energy Threshold" <- w43
    $SNR_dB <- w44
    $iterPerSecond <- w45
    $feedbackIterValue <- w46
    $"sync index" <- w29
    $"loop iteration" <- i1
    $"absolute value" <- w47
    Multiply(w5, w6) -> w49
    case (w4) {
      frame False, Default {
        w50 = w49
      }
      frame True {
        Multiply(w49, $codingRate) -> w50
      }
    }
    case (w3) {
      frame False, Default {
        w51 = w50
      }
      frame True {
        Add(w50, 10) -> w51
      }
    }
    call "extractDataBits.gvi"(appendedArray=w30, dataBitsPerPacket=w51) -> (dataArray=w52)
    case (w3) {
      frame False, Default {
        w53 = w52
        w54 = default
        w55 = default
      }
      frame True {
        call "Deinterleaver.gvi"(input=w52, lengthInterleaver=w24, tolerance=w25) -> (queueOut=w56, queueErrorOut=w57, foundSynchro=w58)
        Get Queue Status(error in (no error)=w57, queue=w56) -> (error out=w59, queue out=w60)
        Dequeue Element(error in (no error)=w59, queue=w60, timeout in ms (-1)=20) -> (element=w53, error out=w55, queue out=w54)
        $InterleaverfoundSynchro <- w58
      }
    }
    case (w4) {
      frame False, Default {
        w61 = w53
      }
      frame True {
        call "ldpcDecoding.gvi"(ReceivedMessage=w53, CheckMatrix=w27, itMax=w26) -> (MesageDecoded=w61)
      }
    }
    call "soundBitStream2Integer.gvi"(bitStream=w61, numberOfSoundSamples=w5, bitsPerSample=w6) -> (integerArray=w62)
    case ($uLaw) {
      frame False, Default {
        To Double Precision Float(number=w62) -> w63
      }
      frame True {
        call "uLawDecodeArray8to16bits.gvi"(X=w62) -> (Y=w63)
      }
    }
    call "deShiftAndMultSoundArray.gvi"(unprocessedSoundArray=w63, correction=w7, multiple=w8) -> (processedArray=w64)
    Property Node(instance in=w9) -> ("sample rate"=w65)
    Reciprocal(x=w65) -> w66
    Build Waveform Node(Y=w64, dt=w66, t0=1904-01-01T00:00:00Z) -> (output waveform=w67)
    Build Array(w67, waveform<f64> {dt=1, Y=[]}) -> w68
    $SoundOutput <- w68
    call "Sound Output Write.gvi"(task ID=w20, data=w68, error in=w21) -> (task ID out=w69, error out=w70)
    Array Size(array=w61) -> (size(s)=w71)
    Is Greater Than 0(x=w71) -> w72
    case (w72) {
      frame False, Default { }
      frame True {
        Feedback Node(Input=w73) -> (Output=w74)
        Divide(x=w71, y=2) -> w75
        Initialize Array(element=0, size=w75) -> w76
        Initialize Array(element=1, size=w75) -> w77
        Interleave Array(w76, w77) -> w78
        Subtract(x=w61, y=w78) -> w79
        Is Not Equal To 0(x=w79) -> w80
        Boolean To Integer(Boolean=w80) -> (0, 1=w81)
        Add Array Elements(numeric array=w81) -> (sum=w82)
        Build Array[ConcatenateInputs=True](w82, w74) -> w83
        case ($reset) {
          frame False, Default {
            w73 = w83
            w84 = w85
          }
          frame True {
            w73 = default
            w84 = default
          }
        }
        Feedback Node(Input=w84) -> (Output=w86)
        Is Greater Than 0(x=w82) -> w87
        case (w87) {
          frame False, Default {
            w85 = w86
          }
          frame True {
            Build Array[ConcatenateInputs=True](w82, w86) -> w85
          }
        }
        $"nonNullDeviationsFrom101010..." <- w85
        To Unsigned Quad Integer(number=w83) -> w88
        Add Array Elements(numeric array=w88) -> (sum=w89)
        Array Size(array=w83) -> (size(s)=w90)
        Multiply(w71, w90) -> w91
        Divide(x=w89, y=w91) -> w92
        $errorRate <- w92
        $"deviationFrom010101..." <- w83
        $"sumDeviationFrom010101..." <- w89
        $nbBitReceived <- w91
      }
    }
    next s1 = w39
    next s2 = w29
    next s3 = w33
    stop if $stopFetchingLoop
  }
  call "niUSRP Abort.gvi"(Handle in=w38, error in (no error)=w40) -> (Handle out=w93, Error Out=w94)
  call "niUSRP Close Session.gvi"(Handle in=w93, error in (no error)=w94)
  Flush Queue(error in (no error)=w55, queue=w54) -> (error out=w95, queue out=w96)
  Release Queue(error in (no error)=w95, queue=w96)
  call "Sound Output Stop.gvi"(task ID=w69, error in=w70) -> (task ID out=w97, error out=w98)
  call "Sound Output Clear.gvi"(task ID=w97, error in=w98)
