vi "SignalAndNoiseEstimate.gvi"   [LabVIEW NXG]
inputs:
  "Use MathScript?": bool
  "data": cluster{"t0": f64, "dt": f64, "Y": c128[]}
outputs:
  "signal_power": f64
  "noise_power": f64
  "Energy Threshold": f64
  "power": f64[]
  "noise_estimation_error ?": bool
  "SNR_dB": f64
diagram:
  Property Node(instance in=$data) -> ("Y"=w1)
  Complex To Real Imaginary(x + iy=w1) -> (x=w2, y=w3)
  call "Hanning Window (DBL).gvi"(x=w2) -> (windowed x=w4)
  call "Mean (DBL).gvi"(X=w4) -> (mean=w5)
  Divide(x=w5, y=0.5) -> w6
  Subtract(x=w2, y=w6) -> w7
  call "Hanning Window (DBL).gvi"(x=w3) -> (windowed x=w8)
  call "Mean (DBL).gvi"(X=w8) -> (mean=w9)
  Divide(x=w9, y=0.5) -> w10
  Subtract(x=w3, y=w10) -> w11
  Real And Imaginary To Complex(x=w7, y=w11) -> w12
  call "SignalAndNoiseCalc.gvi"(Input Complex Samples=w12, Bin Size=5, Use MathScript?=$"Use MathScript?") -> (noise_power=w13, signal_power=w14, Energy Threshold=w15, power=w16, noise_estimation_error ?=w17)
  $signal_power <- w14
  $noise_power <- w13
  $"Energy Threshold" <- w15
  $power <- w16
  $"noise_estimation_error ?" <- w17
  Divide(x=w14, y=w13) -> w18
  Logarithm Base 10(x=w18) -> w19
  Multiply(10, w19) -> w20
  $SNR_dB <- w20
