vi "adjustSamplesToSync.gvi"   [LabVIEW NXG]
inputs:
  "wanted_sync_index": f64
  "current_sync_index": f64
  "packet_size_with_padding": f64
  "first_interation?": bool
  "sync_index_last_iteration": f64
  "samples_last_interation": f64
outputs:
  "new_NumOfSamples": f64
  "last10InRange": bool
panel controls:
  "sync_index_correct_limits": f64 = 5
diagram:
  Feedback Node(Initializer=FALSE, Input=w1) -> (Output=w2)
  case ($"first_interation?") {
    frame False, Default {
      Divide(x=$current_sync_index, y=$wanted_sync_index) -> w4
      Is Greater(x=w4, y=1.02) -> w5
      Is Less(x=w4, y=0.98) -> w6
      Is Greater(x=$current_sync_index, y=$sync_index_last_iteration) -> w7
      Reciprocal(x=w4) -> w8
      Is Greater Or Equal(x=w8, y=2) -> w9
      Subtract(x=$sync_index_last_iteration, y=$current_sync_index) -> w10
      Is Greater(x=w10, y=2) -> w11
      Round Toward Negative Infinity(x=w4) -> w12
      Is Greater Or Equal(x=w12, y=3) -> w13
      case (w5) {
        frame False, Default {
          # Sync index not too high
          case (w6) {
            frame False, Default {
              # Sync index in range
              w3 = $samples_last_interation
              w1 = w2
            }
            frame True {
              # Sync index too low
              case (w7) {
                frame False, Default {
                  # Sync index decreasing
                  case (w2) {
                    frame False, Default {
                      # Didn't decrement
                      # last iteration
                      Decrement(x=$samples_last_interation) -> w3
                      Not(x=w2) -> w1
                    }
                    frame True {
                      # Decremented
                      # last iteration
                      Not(x=w2) -> w1
                      w3 = $samples_last_interation
                    }
                  }
                }
                frame True {
                  # Sync index increasing
                  case (w9) {
                    frame False, Default {
                      # Not less than half
                      w3 = $samples_last_interation
                      w1 = w2
                    }
                    frame True {
                      # Less than half
                      case (w2) {
                        frame False, Default {
                          Decrement(x=$samples_last_interation) -> w3
                          Not(x=w2) -> w1
                        }
                        frame True {
                          # Dec last turn
                          Not(x=w2) -> w1
                          w3 = $samples_last_interation
                        }
                      }
                    }
                  }
                }
              }
            }
          }
        }
        frame True {
          # Current sync index too high
          case (w7) {
            frame False, Default {
              # Sync index decreasing
              case (w11) {
                frame False, Default {
                  # Not decreasing too fast
                  case (w13) {
                    frame False, Default {
                      # Sync index decreasing
                      # and in range
                      w3 = $samples_last_interation
                      w1 = w2
                    }
                    frame True {
                      # Sync index more
                      # than triple
                      case (w2) {
                        frame False, Default {
                          # did not decrement last turn
                          Increment(x=$samples_last_interation) -> w3
                          Not(x=w2) -> w1
                        }
                        frame True {
                          # Incremented
                          # last iteration
                          Not(x=w2) -> w1
                          w3 = $samples_last_interation
                        }
                      }
                    }
                  }
                }
                frame True {
                  # Decreasing too fast
                  case (w2) {
                    frame False, Default {
                      # Did not decrement
                      # last iteration
                      Decrement(x=$samples_last_interation) -> w3
                      Not(x=w2) -> w1
                    }
                    frame True {
                      # did decremented
                      # last iteration
                      Not(x=w2) -> w1
                      w3 = $samples_last_interation
                    }
                  }
                }
              }
            }
            frame True {
              # Sync index increasing
              # Increment samples to
              # decrease sync index
              case (w2) {
                frame False, Default {
                  Increment(x=$samples_last_interation) -> w3
                  Not(x=w2) -> w1
                }
                frame True {
                  # Incremented
                  # last turn
                  Not(x=w2) -> w1
                  w3 = $samples_last_interation
                }
              }
            }
          }
        }
      }
    }
    frame True {
      w3 = $packet_size_with_padding
      w1 = w2
    }
  }
  $new_NumOfSamples <- w3
  call "chectIfLast10IsInRange.gvi"(currentSyncIndex=$current_sync_index, wanted_sync_index=$wanted_sync_index, sync_index_legal_limit=$sync_index_correct_limits) -> (last5InRange=w14)
  $last10InRange <- w14
