vi "calcPacketsPerSecond.gvi"   [LabVIEW NXG]
inputs:
  "last5InRange": bool
  "firstIterValuesIn": cluster{"Element 1": u32, "Element 2": i32}
  "loop iteration": i32
outputs:
  "iterPerSecond": f64
  "firstIterValuesOut": cluster{"Element 1": u32, "Element 2": i32}
panel controls:
  "firstIteration": bool = TRUE
panel indicators:
  "Element 1": u32
  "Element 2": i32
  "millisecond timer value": u32
  "Numeric": i32
diagram:
  Feedback Node(Initializer=TRUE, Input=w1) -> (Output=w2)
  Logical And($last5InRange, w2) -> w3
  Feedback Node(Initializer=$firstIteration, Input=w4) -> (Output=w5)
  Feedback Node(Initializer=0, Input=w6) -> (Output=w7)
  case (w3) {
    frame False, Default {
      w6 = w7
      w4 = w5
      w8 = $firstIterValuesIn
      w1 = TRUE
    }
    frame True {
      case (w5) {
        frame False, Default {
          # After first time
          # last5InRage is true
          w4 = w5
          w8 = $firstIterValuesIn
        }
        frame True {
          Not(x=w5) -> w4
          Tick Count() -> (millisecond timer value=w9)
          # Start counter
          # First time
          # last5InRange
          # is true
          Build Cluster(w9, $"loop iteration") -> w8
        }
      }
      Property Node(instance in=w8) -> ("Element 1"=w10, "Element 2"=w11)
      $"Element 1" <- w10
      $"Element 2" <- w11
      Subtract(x=$"loop iteration", y=w11) -> w12
      Quotient And Remainder(x=w11, y=100) -> (floor(x/y)=w13)
      Quotient And Remainder(x=$"loop iteration", y=100) -> (floor(x/y)=w14)
      Subtract(x=w14, y=w13) -> w15
      Is Greater Or Equal(x=w15, y=2) -> w16
      Logical And(w16, w2) -> w17
      case (w17) {
        frame False, Default {
          w6 = 0
          w1 = w2
        }
        frame True {
          Tick Count() -> (millisecond timer value=w18)
          $"millisecond timer value" <- w18
          Subtract(x=w18, y=w10) -> w19
          Divide(x=w19, y=1000) -> w20
          # Stop counter
          Divide(x=w12, y=w20) -> w6
          Not(x=w2) -> w1
        }
      }
      $Numeric <- $"loop iteration"
    }
  }
  $firstIterValuesOut <- w8
  $iterPerSecond <- w6
