vi "chectIfLast10IsInRange.gvi"   [LabVIEW NXG]
inputs:
  "currentSyncIndex": f64
  "wanted_sync_index": f64
  "sync_index_legal_limit": f64
outputs:
  "last5InRange": bool
diagram:
  Feedback Node(Initializer=0, Input=$currentSyncIndex) -> (Output=w1)
  Feedback Node(Initializer=0, Input=w1) -> (Output=w2)
  Feedback Node(Initializer=0, Input=w2) -> (Output=w3)
  Feedback Node(Initializer=0, Input=w3) -> (Output=w4)
  Feedback Node(Input=w4) -> (Output=w5)
  Feedback Node(Input=w5) -> (Output=w6)
  Feedback Node(Input=w6) -> (Output=w7)
  Feedback Node(Input=w7) -> (Output=w8)
  Feedback Node(Input=w8) -> (Output=w9)
  Feedback Node(Input=w9) -> (Output=w10)
  Add($wanted_sync_index, $sync_index_legal_limit) -> w11
  Subtract(x=$wanted_sync_index, y=$sync_index_legal_limit) -> w12
  In Range And Coerce(lower limit=w12, upper limit=w11, x=w10) -> (In Range?=w13)
  In Range And Coerce(lower limit=w12, upper limit=w11, x=w9) -> (In Range?=w14)
  In Range And Coerce(lower limit=w12, upper limit=w11, x=w8) -> (In Range?=w15)
  In Range And Coerce(lower limit=w12, upper limit=w11, x=w7) -> (In Range?=w16)
  In Range And Coerce(lower limit=w12, upper limit=w11, x=w6) -> (In Range?=w17)
  In Range And Coerce(lower limit=w12, upper limit=w11, x=w5) -> (In Range?=w18)
  In Range And Coerce(lower limit=w12, upper limit=w11, x=w4) -> (In Range?=w19)
  In Range And Coerce(lower limit=w12, upper limit=w11, x=w3) -> (In Range?=w20)
  In Range And Coerce(lower limit=w12, upper limit=w11, x=w2) -> (In Range?=w21)
  In Range And Coerce(lower limit=w12, upper limit=w11, x=w1) -> (In Range?=w22)
  Logical And(w22, w21, w20, w19, w18, w17, w16, w15, w14, w13) -> w23
  $last5InRange <- w23
