vi "deShiftAndMultSoundArray.gvi"   [LabVIEW NXG]
inputs:
  "unprocessedSoundArray": f64[]
  "correction": f64
  "multiple": f64
outputs:
  "processedArray": f64[]
diagram:
  for {
    w1 = each element of $unprocessedSoundArray
    Divide(x=w1, y=$multiple) -> w3
    Subtract(x=w3, y=$correction) -> w4
    append w4 to w2
  }
  $processedArray <- w2
