vi "fastDemodBlock.gvi"   [LabVIEW NXG]
inputs:
  "data": cluster{"t0": f64, "dt": f64, "Y": c128[]}
  "PSK_params_in": T3
outputs:
  "output bit stream": i8[]
  "sync found index": f64
panel indicators:
  "Sync_Found?": bool
types:
  T1 = cluster{"samples per symbol (16)": i32, "symbol map": c128[], "differential PSK": enum{"disable", "enable"}, "PSK type": enum{"normal", "shifted", "offset"}}
  T2 = cluster{"expected sync location (symbols)": i32, "sync sequence": c128[], "sync location uncertainty (symbols)": i32, "sync indent (symbols)": i32}
  T3 = cluster{"psk_system_params": T1, "pulse_shaping_filter_coeffs": f64[], "matched_filter_coeffs": f64[], "sync_params": T2, "sync_seq_bits": i8[]}
diagram:
  Property Node(instance in=$PSK_params_in) -> ("psk_system_params"=w1, "sync_params"=w2, "matched_filter_coeffs"=w3)
  Property Node(instance in=$data) -> ("Y"=w4)
  Is Empty Array(array=w4) -> w5
  case (w5) {
    frame False, Default {
      call "MT Detect PSK.gvi"(input complex waveform=$data, PSK system parameters=w1, synchronization parameters=w2, matched filter coefficients=w3) -> (output bit stream=w6, sync found index=w7)
    }
    frame True {
      w6 = i8[] []
      w7 = 0
    }
  }
  $"output bit stream" <- w6
  $"sync found index" <- w7
  Is Greater Than 0(x=w7) -> w8
  $"Sync_Found?" <- w8
