vi "initPSK.gvi"   [LabVIEW NXG]
inputs:
  "PSK type": enum{"normal", "shifted", "offset"} = "normal"
  "samples per symbol": i32 = 16
  "M-PSK": i32 = 4
  "modulation type": T4 = "PSK"
  "pulse shaping filter": T5 = "Root Raised Cos"
  "filter parameter": f64 = 0.5
  "PSK_params_in": T3
outputs:
  "PSK_params_out": T3
types:
  T1 = cluster{"samples per symbol (16)": i32, "symbol map": c128[], "differential PSK": enum{"disable", "enable"}, "PSK type": enum{"normal", "shifted", "offset"}}
  T2 = cluster{"expected sync location (symbols)": i32, "sync sequence": c128[], "sync location uncertainty (symbols)": i32, "sync indent (symbols)": i32}
  T3 = cluster{"psk_system_params": T1, "pulse_shaping_filter_coeffs": f64[], "matched_filter_coeffs": f64[], "sync_params": T2, "sync_seq_bits": i8[]}
  T4 = enum{"FSK", "PSK", "QAM", "MSK", "PAM", "ASK", "CPM"}
  T5 = enum{"none", "Raised Cosine", "Root Raised Cos", "Gaussian"}
diagram:
  call "MT Generate PSK System Parameters(M).gvi"(samples per symbol=$"samples per symbol", M-PSK=$"M-PSK", PSK type=$"PSK type") -> (PSK system parameters=w1)
  call "MT Generate Filter Coefficients.gvi"(pulse shaping filter=$"pulse shaping filter", filter parameter=$"filter parameter", modulation type=$"modulation type") -> (pulse shaping filter coefficients=w2, matched filter coefficients=w3)
  call "MT Generate Bits (Galois, PN Order).gvi"(total bits=32, PN sequence order=9) -> (output bit stream=w4)
  call "MT Generate PSK Synchronization Parameters (bit array).gvi"(PSK system parameters=w1, sync bits=w4) -> (PSK synchronization parameters=w5)
  Property Node(instance in=$PSK_params_in, "psk_system_params"=w1, "pulse_shaping_filter_coeffs"=w2, "matched_filter_coeffs"=w3, "sync_seq_bits"=w4, "sync_params"=w5) -> (instance out=w6)
  $PSK_params_out <- w6
