vi "recordPacketErrors.gvi"   [LabVIEW NXG]
inputs:
  "packet": f64[]
  "reset": bool
  "sync": i32
panel indicators:
  "deviationFrom010101...": i16[]
  "sumDeviationFrom010101...": u64
  "errorRate": f64
  "nbBitReceived": i32
  "nonNullDeviationsFrom101010...": i32[][]
  "averageNonNullDeviation": f64
  "averageTimeSinceLast": f64
diagram:
  Feedback Node(Input=w1) -> (Output=w2)
  Array Size(array=$packet) -> (size(s)=w3)
  Divide(x=w3, y=2) -> w4
  Initialize Array(element=0, size=w4) -> w5
  Initialize Array(element=1, size=w4) -> w6
  Interleave Array(w5, w6) -> w7
  Subtract(x=$packet, y=w7) -> w8
  Is Not Equal To 0(x=w8) -> w9
  Boolean To Integer(Boolean=w9) -> (0, 1=w10)
  Add Array Elements(numeric array=w10) -> (sum=w11)
  Build Array[ConcatenateInputs=True](w11, w2) -> w12
  case ($reset) {
    frame False, Default {
      w1 = w12
      w13 = w14
    }
    frame True {
      w1 = default
      w13 = default
    }
  }
  Feedback Node(Input=w13) -> (Output=w15)
  Is Greater Than 0(x=w11) -> w16
  Feedback Node(Input=w17) -> (Output=w18)
  case (w16) {
    frame False, Default {
      Increment(x=w18) -> w17
      w14 = w15
    }
    frame True {
      Build Array(w11, w18, $sync) -> w19
      Build Array[ConcatenateInputs=True](w19, w15) -> w14
      w17 = 0
    }
  }
  $"nonNullDeviationsFrom101010..." <- w14
  Array Size(array=w14) -> (size(s)=w20)
  Array Index(array=w20) -> (out0[0]=w21)
  Array Subset(array=w14, length0=w21, length1=1) -> w22
  Reshape Array(inArray=w22, size=w21) -> w23
  Add Array Elements(numeric array=w23) -> (sum=w24)
  Divide(x=w24, y=w21) -> w25
  $averageNonNullDeviation <- w25
  Array Subset(array=w14, length0=w21, index1=1, length1=1) -> w26
  Reshape Array(inArray=w26, size=w21) -> w27
  Add Array Elements(numeric array=w27) -> (sum=w28)
  Divide(x=w28, y=w21) -> w29
  $averageTimeSinceLast <- w29
  To Unsigned Quad Integer(number=w12) -> w30
  Add Array Elements(numeric array=w30) -> (sum=w31)
  Array Size(array=w12) -> (size(s)=w32)
  Multiply(w3, w32) -> w33
  Divide(x=w31, y=w33) -> w34
  $errorRate <- w34
  $"deviationFrom010101..." <- w12
  $"sumDeviationFrom010101..." <- w31
  $nbBitReceived <- w33
