vi "soundBitStream2Integer.gvi"   [LabVIEW NXG]
inputs:
  "bitStream": i8[]
  "numberOfSoundSamples": i32
  "bitsPerSample": i32 = 8
outputs:
  "integerArray": u8[]
diagram:
  for (N = $numberOfSoundSamples) (iteration -> i1) {
    Multiply($bitsPerSample, i1) -> w2
    Array Subset(array=$bitStream, index0=w2, length0=$bitsPerSample) -> w3
    for {
      w4 = each element of w3
      Is Not Equal To 0(x=w4) -> w6
      append w6 to w5
    }
    Reverse 1D Array(array=w5) -> (reversed array=w7)
    Boolean Array To Number(Boolean array=w7) -> (number=w8)
    To Unsigned Byte Integer(number=w8) -> w9
    append w9 to w1
  }
  $integerArray <- w1
