vi "SoundTestbench.gvi"   [LabVIEW NXG]
panel controls:
  "stopRecoringSound": bool
  "stopPlayingSound": bool
  "correcting": f64
  "multiple": f64 = 1000
  "numOfSampPerChannel": i32 = 128
  "bitsPerChannel": i32 = 8
panel indicators:
  "data": waveform<f64>[]
  "arrayFromQueue": u32[]
  "arrayFromQueue_size": i32
  "error out_2": error
  "sizeOfClusterArray": i32
  "numElementsInInputQueue": i32
  "Y_intoSoundOutput": f64[]
  "currentMax": f64
  "absoluteMax": f64
  "currentMin": f64
  "absoluteMin": f64
types:
  T1 = cluster{"Element 1": i8[], "Element 2": timestamp, "Element 3": f64}
  T2 = cluster{"sample rate": f64, "number of channels": i32, "bits per sample": i32}
diagram:
  w1 = $correcting
  w2 = $multiple
  w3 = $bitsPerChannel
  w4 = $numOfSampPerChannel
  Obtain Queue(element data type=T1 {all zero or empty}, max queue size (-1, unlimited)=2000, name (unnamed)="sound_bit_stream") -> (queue out=w5)
  w6 = T2 {"sample rate"=8000, "number of channels"=1, "bits per sample"=16}
  call "Sound Input Configure.gvi"(device ID=0, sound format=w6, sample mode=1, number of samples per channel=8000) -> (task ID=w7, error out=w8)
  call "Sound Input Start.gvi"(task ID=w7, error in=w8) -> (task ID out=w9, error out=w10)
  s1 = 10  # shift register
  s2 = 200  # shift register
  while {
    call "Sound Input Read.gvi"(task ID=w9, error in=w10, number of samples per channel=w4, timeout=-1) -> (task ID out=w11, data=w12, error out=w13)
    for {
      w14 = each element of w12
      Property Node(instance in=w14) -> ("Y"=w15, "t0"=w16, "dt"=w17)
    }
    call "shiftAndMultSoundArray.gvi"(soundArray_raw=w15, correction=w1, multiply=w2) -> (processedSoundArray=w18)
    call "minAndMax.gvi"(dblArrayz=w18, oldMax=s1, oldMin=s2) -> (currentMax=w19, absoluteMax=w20, currentMin=w21, absoluteMin=w22)
    $currentMax <- w19
    $absoluteMax <- w20
    $currentMin <- w21
    $absoluteMin <- w22
    $data <- w12
    Get Queue Status(queue=w5) -> (# elements in queue=w23, queue out=w24)
    To Unsigned Byte Integer(number=w18) -> w25
    for {
      w26 = each element of w25
      Number To Boolean Array(number=w26) -> (Boolean array=w28)
      Boolean To Integer(Boolean=w28) -> (0, 1=w29)
      To Byte Integer(number=w29) -> w30
      append w30 to w27
    }
    Multiply(w3, w4) -> w31
    Reshape Array(inArray=w27, size=w31) -> w32
    Build Cluster(w32, w16, w17) -> w33
    Enqueue Element(element=w33, queue=w24)
    $numElementsInInputQueue <- w23
    next s1 = w20
    next s2 = w22
    stop if $stopRecoringSound
  }
  call "Sound Input Stop.gvi"(task ID=w11, error in=w13) -> (task ID out=w34, error out=w35)
  call "Sound Input Clear.gvi"(task ID=w34, error in=w35)
  w36 = T2 {"sample rate"=8000, "number of channels"=1, "bits per sample"=8}
  call "Sound Output Configure.gvi"(device ID=0, sound format=w36, sample mode=1, number of samples per channel=8000) -> (task ID=w37, error out=w38)
  call "Sound Output Start.gvi"(task ID=w37, error in=w38) -> (task ID out=w39, error out=w40)
  while {
    Dequeue Element(queue=w5) -> (element=w41, queue out=w42)
    Property Node(instance in=w41) -> ("Element 1"=w43)
    for (N = w4) (iteration -> i1) {
      Multiply(w3, i1) -> w45
      Array Subset(array=w43, index0=w45, length0=w3) -> w46
      for {
        w47 = each element of w46
        Is Not Equal To 0(x=w47) -> w49
        append w49 to w48
      }
      Boolean Array To Number(Boolean array=w48) -> (number=w50)
      append w50 to w44
    }
    To Double Precision Float(number=w44) -> w51
    Divide(x=w51, y=w2) -> w52
    Subtract(x=w52, y=w1) -> w53
    Property Node(instance in=w41) -> ("Element 3"=w54, "Element 2"=w55)
    Build Waveform Node(Y=w53, dt=w54, t0=w55) -> (output waveform=w56)
    Build Array(w56, waveform<f64> {dt=1, Y=[]}) -> w57
    call "Sound Output Write.gvi"(task ID=w39, data=w57, error in=w40) -> (task ID out=w58, error out=w59)
    $Y_intoSoundOutput <- w53
    Array Size(array=w44) -> (size(s)=w60)
    $arrayFromQueue_size <- w60
    $arrayFromQueue <- w44
    Array Size(array=w57) -> (size(s)=w61)
    $sizeOfClusterArray <- w61
    stop if $stopPlayingSound
  }
  Release Queue(queue=w42)
  call "Sound Output Stop.gvi"(task ID=w58, error in=w59) -> (task ID out=w62, error out=w63)
  call "Sound Output Clear.gvi"(task ID=w62, error in=w63) -> (error out=w64)
  $"error out_2" <- w64
