vi "minAndMax.gvi"   [LabVIEW NXG]
inputs:
  "dblArrayz": f64[]
  "oldMax": f64
  "oldMin": f64
outputs:
  "currentMax": f64
  "absoluteMax": f64
  "currentMin": f64
  "absoluteMin": f64
diagram:
  Array Max And Min(array=$dblArrayz) -> (max value=w1, min value=w2)
  $currentMax <- w1
  Is Greater(x=w1, y=$oldMax) -> w3
  Select(s=w3, t=w1, f=$oldMax) -> w4
  $absoluteMax <- w4
  $currentMin <- w2
  Is Less(x=w2, y=$oldMin) -> w5
  Select(s=w5, t=w2, f=$oldMin) -> w6
  $absoluteMin <- w6
