vi "soundtest.gvi"   [LabVIEW NXG]
panel controls:
  "volume": f64 = 100
  "mult": f64 = 100000
  "samp_pr_chan": i32 = 100000
  "positive_value_corr_2": f64 = 100000
diagram:
  call "Rx_bitstreamtosound.gvi"(mult=$mult, volume=$volume, positive_value_corr=$positive_value_corr_2, samp_pr_chan=$samp_pr_chan)
  call "Tx_soundtobitstream.gvi"(Positive_value_correct=$positive_value_corr_2, mult=$mult, samp_pr_chan=$samp_pr_chan)
