vi "Tx_main.gvi"   [LabVIEW NXG]
panel controls:
  "IQ_Rate": f64 = 500000
  "f0": f64 = 2450000000
  "Gain": f64 = 10
  "modulation type": T1 = "PSK"
  "PSK type": enum{"normal", "shifted", "offset"} = "normal"
  "samples per symbol": i32 = 16
  "pulse shaping filter": T2 = "Root Raised Cos"
  "filter parameter": f64 = 0.5
  "filter length": i32 = 8
  "stopRecoringSound": bool
  "stopDataEnqueing": bool
  "stopSendingData": bool
  "SamplesPerChannel": i32 = 128
  "multiple": f64 = 1000
  "correction": f64 = 0.02
  "bitsPerSample": i32 = 8
  "uLaw": bool
  "LDPC": bool
  "GeneratorMatrixLocation": path
  "interleaverLength": f64
  "interleave": bool
  "send010101...": bool
panel indicators:
  "data": waveform<f64>[]
  "PacketGraph": cluster{"t0": f64, "dt": f64, "Y": c128[]}
  "IQ Graph": T3[]
  "numOfElementInRadioQueue2": i32
  "numOfElementInSoundQueue": i32
  "numOfElementInSoundQueue2": i32
  "numOfElementInRadioQueue": i32
  "loop iteration": i32
  "loop iteration_2": i32
  "loop iteration_3": i32
  "interleaverInput": f64[]
  "packetSizes": i32[]
  "numOfElemetInInterleaverOutQueue": i32
types:
  T1 = enum{"FSK", "PSK", "QAM", "MSK", "PAM", "ASK", "CPM"}
  T2 = enum{"none", "Raised Cosine", "Root Raised Cos", "Gaussian"}
  T3 = cluster{"constellation": f64[], "oversampled data": f64[]}
  T4 = cluster{"sample rate": f64, "number of channels": i32, "bits per sample": i32}
diagram:
  w1 = $LDPC
  w2 = $SamplesPerChannel
  w3 = $bitsPerSample
  w4 = $correction
  w5 = $multiple
  Obtain Queue(element data type=i8[] [], max queue size (-1, unlimited)=2000, name (unnamed)="sound_bit_stream") -> (error out=w6, queue out=w7)
  w8 = T4 {"sample rate"=6000, "number of channels"=1, "bits per sample"=16}
  call "Sound Input Configure.gvi"(device ID=0, sound format=w8, sample mode=1, number of samples per channel=8000) -> (task ID=w9, error out=w10)
  call "Sound Input Start.gvi"(task ID=w9, error in=w10) -> (task ID out=w11, error out=w12)
  case (w1) {
    frame False, Default {
      w13 = default
    }
    frame True {
      call "Read from Spreadsheet File (DBL).gvi"(file path=$GeneratorMatrixLocation, format="%.3f", delimiter=",") -> (all rows=w13)
    }
  }
  w14 = $"send010101..."
  while (iteration -> i1) {
    Multiply(w2, w3) -> w15
    call "Sound Input Read.gvi"(task ID=w11, error in=w12, number of samples per channel=w2, timeout=-1) -> (task ID out=w16, data=w17, error out=w18)
    for {
      w19 = each element of w17
      Property Node(instance in=w19) -> ("Y"=w20)
    }
    call "shiftAndMultSoundArray.gvi"(soundArray_raw=w20, correction=w4, multiply=w5) -> (processedSoundArray=w21)
    case ($uLaw) {
      frame False, Default {
        To Unsigned Byte Integer(number=w21) -> w22
      }
      frame True {
        call "uLawCodeArray16to8.gvi"(X=w21) -> (Y=w22)
      }
    }
    call "intArray2BitStream.gvi"(unsigned 8-bit integer=w22) -> (array=w23)
    Reshape Array(inArray=w23, size=w15) -> w24
    case (w14) {
      frame False, Default {
        w25 = w24
      }
      frame True {
        Array Size(array=w24) -> (size(s)=w26)
        Divide(x=w26, y=2) -> w27
        Initialize Array(element=0, size=w27) -> w28
        Initialize Array(element=1, size=w27) -> w29
        Interleave Array(w28, w29) -> w25
      }
    }
    case (w1) {
      frame False, Default {
        w30 = w25
      }
      frame True {
        call "ldpcDenseCoding.gvi"(Message=w25, generatorMatrix=w13) -> (EncodedMessage=w30)
      }
    }
    case ($interleave) {
      frame False, Default {
        w31 = w30
        w32 = default
        w33 = default
      }
      frame True {
        call "Interleaver.gvi"(input=w30, lengthInterleaver=$interleaverLength) -> (queueOut=w34, queueErrorOut=w35)
        Get Queue Status(error in (no error)=w35, queue=w34) -> (# elements in queue=w36, error out=w37, queue out=w38)
        Dequeue Element(error in (no error)=w37, queue=w38, timeout in ms (-1)=20) -> (element=w31, error out=w33, queue out=w32)
        $numOfElemetInInterleaverOutQueue <- w36
      }
    }
    call "createPacket.gvi"(dataBitStream=w31) -> (packet=w39)
    Array Size(array=w39) -> (size(s)=w40)
    Feedback Node(Input=w41) -> (Output=w42)
    Insert Into Array(inArray=w42, index0=0, new=w40) -> w41
    $packetSizes <- w41
    Get Queue Status(error in (no error)=w6, queue=w7) -> (# elements in queue=w43, error out=w44, queue out=w45)
    Lossy Enqueue Element(element=w39, error in (no error)=w44, queue=w45)
    $data <- w17
    $numOfElementInSoundQueue <- w43
    $interleaverInput <- w30
    $"loop iteration" <- i1
    stop if $stopRecoringSound
  }
  Flush Queue(error in (no error)=w33, queue=w32) -> (error out=w46, queue out=w47)
  Release Queue(error in (no error)=w46, queue=w47)
  call "Sound Input Stop.gvi"(task ID=w16, error in=w18) -> (task ID out=w48, error out=w49)
  call "Sound Input Clear.gvi"(task ID=w48, error in=w49)
  w50 = $"samples per symbol"
  w51 = $"PSK type"
  w52 = $"modulation type"
  w53 = $"pulse shaping filter"
  w54 = $"filter parameter"
  w55 = $"filter length"
  w56 = cluster{"t0": f64, "dt": f64, "Y": c128[]} {"t0"=0, "dt"=1, "Y"=[]}
  Obtain Queue(element data type=w56, max queue size (-1, unlimited)=5000, name (unnamed)="enqueDataForRadio") -> (error out=w57, queue out=w58)
  call "niUSRP Open Tx Session.gvi"(Device names="192.168.10.2", Reset=TRUE) -> (Error Out=w59, Session handle=w60)
  call "niUSRP Configure Signal.gvi"(session handle=w60, IQ rate=$IQ_Rate, carrier frequency=$f0, gain=$Gain, error in (no error)=w59, active antenna="TX1") -> (session handle out=w61, coerced IQ rate=w62)
  while (iteration -> i2) {
    $"loop iteration_2" <- i2
    Get Queue Status(error in (no error)=w6, queue=w7) -> (# elements in queue=w63, error out=w64, queue out=w65)
    Dequeue Element(error in (no error)=w64, queue=w65) -> (element=w66, error out=w67, queue out=w68)
    call "modulation_block.gvi"(modulation type=w52, PSK type=w51, pulse shaping filter=w53, filter parameter=w54, filter length=w55, input bit stream=w66, samples per symbol=w50, IQ_Rate=w62) -> (modulated_complex_waveform=w69)
    Get Queue Status(error in (no error)=w67, queue=w58) -> (# elements in queue=w70, error out=w71, queue out=w72)
    Lossy Enqueue Element(element=w69, error in (no error)=w71, queue=w72)
    $numOfElementInSoundQueue2 <- w63
    $numOfElementInRadioQueue <- w70
    stop if $stopDataEnqueing
  }
  Flush Queue(queue=w68) -> (queue out=w73)
  Release Queue(queue=w73)
  while (iteration -> i3) {
    Get Queue Status(error in (no error)=w57, queue=w58) -> (# elements in queue=w74, error out=w75, queue out=w76)
    Dequeue Element(error in (no error)=w75, queue=w76) -> (element=w77, queue out=w78)
    call "addPadding.gvi"(dataIn=w77) -> (paddedDataOut=w79)
    call "niUSRP Write Tx Data (CDB Cluster).gvi"(session handle=w61, data=w79, end of data?=$stopSendingData) -> (session handle out=w80, Error Out=w81)
    $PacketGraph <- w79
    call "MT Format Constellation.gvi"(waveform=w79) -> (constellation graph=w82)
    $"IQ Graph" <- w82
    $numOfElementInRadioQueue2 <- w74
    $"loop iteration_3" <- i3
    stop if $stopSendingData
  }
  Flush Queue(queue=w78) -> (queue out=w83)
  Release Queue(queue=w83)
  call "niUSRP Close Session.gvi"(Handle in=w80, error in (no error)=w81)
