vi "createEmptyCluster.gvi"   [LabVIEW NXG]
inputs:
  "coerced IQ rate": f64 = 100000
outputs:
  "Cluster": cluster{"t0": f64, "dt": f64, "Y": c128[]}
diagram:
  w1 = cluster{"t0": f64, "dt": f64, "Y": c128[]} {all zero or empty}
  Initialize Array(element=0+0i, size=500) -> w2
  Reciprocal(x=$"coerced IQ rate") -> w3
  Property Node(instance in=w1, "Y"=w2, "dt"=w3, "t0"=0) -> (instance out=w4)
  $Cluster <- w4
