vi "intArray2BitStream.gvi"   [LabVIEW NXG]
inputs:
  "unsigned 8-bit integer": u8[]
outputs:
  "array": i8[][]
diagram:
  for {
    w1 = each element of $"unsigned 8-bit integer"
    Number To Boolean Array(number=w1) -> (Boolean array=w3)
    Boolean To Integer(Boolean=w3) -> (0, 1=w4)
    To Byte Integer(number=w4) -> w5
    Reverse 1D Array(array=w5) -> (reversed array=w6)
    append w6 to w2
  }
  $array <- w2
