vi "modulation_block.gvi"   [LabVIEW NXG]
inputs:
  "modulation type": T1 = "PSK"
  "PSK type": enum{"normal", "shifted", "offset"} = "normal"
  "pulse shaping filter": T3 = "Root Raised Cos"
  "filter parameter": f64 = 0.5
  "filter length": i32 = 8
  "input bit stream": i8[]
  "samples per symbol": i32 = 16
  "IQ_Rate": f64
outputs:
  "modulated_complex_waveform": cluster{"t0": f64, "dt": f64, "Y": c128[]}
  "IQ Graph": T2[]
types:
  T1 = enum{"FSK", "PSK", "QAM", "MSK", "PAM", "ASK", "CPM"}
  T2 = cluster{"constellation": f64[], "oversampled data": f64[]}
  T3 = enum{"none", "Raised Cosine", "Root Raised Cos", "Gaussian"}
diagram:
  call "MT Format Constellation.gvi"(samples per symbol=$"samples per symbol") -> (constellation graph=w1)
  $"IQ Graph" <- w1
  call "MT Generate PSK System Parameters(M).gvi"(samples per symbol=$"samples per symbol", PSK type=$"PSK type") -> (PSK system parameters=w2)
  call "MT Generate Filter Coefficients.gvi"(pulse shaping filter=$"pulse shaping filter", matched samples per symbol=$"samples per symbol", filter parameter=$"filter parameter", modulation type=$"modulation type", filter length=$"filter length") -> (pulse shaping filter coefficients=w3)
  To Double Precision Float(number=$"samples per symbol") -> w4
  Divide(x=$IQ_Rate, y=w4) -> w5
  call "MT Modulate PSK.gvi"(input bit stream=$"input bit stream", PSK system parameters=w2, symbol rate=w5, pulse shaping filter coefficients=w3) -> (output complex waveform=w6)
  $modulated_complex_waveform <- w6
