vi "adjust_Samples_to_sync_UNUSED.gvi"   [LabVIEW NXG]
inputs:
  "wanted_sync_index": f64
  "current_sync_index": f64
  "packet_size_with_padding": f64
  "first_interation?": bool
  "sync_location_last_iteration": f64
  "samples_last_interation": f64
outputs:
  "new_NumOfSamples": f64
diagram:
  case ($"first_interation?") {
    frame False, Default {
      Is Greater(x=$sync_location_last_iteration, y=$current_sync_index) -> w2
      Is Greater(x=$current_sync_index, y=$wanted_sync_index) -> w3
      Is Less(x=$current_sync_index, y=$wanted_sync_index) -> w4
      # Sync index decreasing?
      case (w3) {
        frame False, Default {
          case (w4) {
            frame False, Default {
              # Sync index perfect :)
              w1 = $samples_last_interation
            }
            frame True {
              # Sync index too low
              Subtract(x=$samples_last_interation, y=1) -> w1
            }
          }
        }
        frame True {
          # Current sync index too high
          case (w2) {
            frame False, Default {
              # Increase samples to
              # decrease sync index
              Add($samples_last_interation, 1) -> w1
            }
            frame True {
              # Sync index is decreasing,
              # which is good
              w1 = $samples_last_interation
            }
          }
        }
      }
    }
    frame True {
      w1 = $packet_size_with_padding
    }
  }
  $new_NumOfSamples <- w1
