vi "sub_Ave_Power_And_Thresholding.gvi"   [LabVIEW NXG]
inputs:
  "Input Complex Samples": c128[]
  "bin_size": i32
  "threshold": f64
outputs:
  "Averaged Power Signal": f64[]
  "Thresholded Signal": bool[]
diagram:
  Array Size(array=$"Input Complex Samples") -> (size(s)=w1)
  Subtract(x=w1, y=$bin_size) -> w2
  Complex To Polar(r * e^(i*theta)=$"Input Complex Samples") -> (r=w3)
  Square(x=w3) -> w4
  for (N = w2) (iteration -> i1) {
    Array Subset(array=w4, index0=i1, length0=$bin_size) -> w6
    Add Array Elements(numeric array=w6) -> (sum=w7)
    append w7 to w5
  }
  $"Averaged Power Signal" <- w5
  Is Greater(x=w5, y=$threshold) -> w8
  $"Thresholded Signal" <- w8
