vi "sub_Chop_Packet.gvi"   [LabVIEW NXG]
inputs:
  "Input Complex Samples": c128[]
  "Energy Threshold": f64 = 1e-05
  "bin_size": i32 = 16
outputs:
  "packet_arr": c128[][]
  "Packet Detection Error?": bool
panel indicators:
  "Averaged Power Signal": f64[]
  "Thresholded Signal": bool[]
  "packet_start_loc": i32[]
diagram:
  call "sub_Ave_Power_And_Thresholding.gvi"(Input Complex Samples=$"Input Complex Samples", bin_size=$bin_size, threshold=$"Energy Threshold") -> (Averaged Power Signal=w1, Thresholded Signal=w2)
  call "sub_Extract_Packet_Boundaries - G.gvi"(Thresholded Signal=w2) -> (packet_start_loc=w3, packet_end_loc=w4, Packet Detection Error?=w5)
  $packet_start_loc <- w3
  $"Averaged Power Signal" <- w1
  $"Thresholded Signal" <- w2
  Not(x=w5) -> w6
  call "sub_Extract_Packets.gvi"(packet_start_loc=w3, packet_end_loc=w4, Input Complex Samples=$"Input Complex Samples", Enable?=w6) -> (packet_arr=w7)
  $packet_arr <- w7
  $"Packet Detection Error?" <- w5
