vi "sub_Init_PSK_At_Rx.gvi"   [LabVIEW NXG]
inputs:
  "PSK Parameters": T1
  "PN sequence order (9)": i32 = 9
  "filter parameters": T3 = {"Alpha"=0.5, "Filter Length"=6, "TX Filter"="Root Raised Cos"}
  "error in (no error)": error
  "synchronization parameters": T5 = {"expected sync location (symbols)"=-1, "sync sequence"=[], "sync location uncertainty (symbols)"=0, "sync indent (symbols)"=0}
  "Sync Bits": i32 = 20
outputs:
  "PSK Init Parameters": T6
  "error out": error
types:
  T1 = cluster{"Samples per Symbol": i32, "Differential PSK": enum{"disable", "enable"}, "M": i32, "PSK Type": i32}
  T2 = enum{"none", "Raised Cosine", "Root Raised Cos", "Gaussian"}
  T3 = cluster{"Alpha": f64, "Filter Length": i32, "TX Filter": T2}
  T4 = cluster{"samples per symbol (16)": i32, "symbol map": c128[], "differential PSK": enum{"disable", "enable"}, "PSK type": u16}
  T5 = cluster{"expected sync location (symbols)": i32, "sync sequence": c128[], "sync location uncertainty (symbols)": i32, "sync indent (symbols)": i32}
  T6 = cluster{"PSK system parameters": T4, "pulse shaping filter coefficients": f64[], "matched filter coefficients": f64[], "synchronization parameters": T5, "Sync Bits": i8[]}
diagram:
  Property Node(instance in=$"PSK Parameters") -> ("Samples per Symbol"=w1, "PSK Type"=w2, "Samples per Symbol"=w3, "M"=w4, "Differential PSK"=w5)
  call "MT Generate PSK System Parameters(M).gvi"(samples per symbol=w3, M-PSK=w4, differential PSK=w5, error in=$"error in (no error)", PSK type=w2) -> (PSK system parameters=w6, error out=w7)
  w8 = "PSK"  # Enum
  Property Node(instance in=$"filter parameters") -> ("TX Filter"=w9, "Alpha"=w10, "Filter Length"=w11)
  call "MT Generate Filter Coefficients.gvi"(pulse shaping filter=w9, pulse shaping samples per symbol=w1, matched samples per symbol=w1, filter parameter=w10, error in=w7, modulation type=w8, filter length=w11) -> (pulse shaping filter coefficients=w12, matched filter coefficients=w13, error out=w14)
  call "MT Generate Bits (Galois, PN Order).gvi"(total bits=$"Sync Bits", PN sequence order=$"PN sequence order (9)") -> (output bit stream=w15)
  Property Node(instance in=w6) -> ("symbol map"=w16, "PSK type"=w17, "differential PSK"=w18)
  call "MT Map Bits to PSK Symbols.gvi"(PSK type=w17, input bit stream=w15, symbol map=w16, error in=w14, differential PSK=w18) -> (symbols=w19, error out=w20)
  Property Node(instance in=$"synchronization parameters", "sync sequence"=w19) -> (instance out=w21)
  Property Node(instance in=$"PSK Init Parameters", "PSK system parameters"=w6, "synchronization parameters"=w21, "pulse shaping filter coefficients"=w12, "matched filter coefficients"=w13, "Sync Bits"=w15) -> (instance out=w22)
  $"PSK Init Parameters" <- w22
  $"error out" <- w20
