vi "sub_est_noise_power - G1.gvi"   [LabVIEW NXG]
inputs:
  "Input Complex Samples": c128[]
  "Bin Size": i32 = 100
  "Use MathScript?": bool
outputs:
  "noise_power": f64
  "Energy Threshold": f64
  "noise_estimation_error ?": bool
  "signal_power": f64
panel indicators:
  "power": f64[]
diagram:
  case ($"Use MathScript?") {
    frame False, Default {
      Complex To Polar(r * e^(i*theta)=$"Input Complex Samples") -> (r=w6)
      Square(x=w6) -> w7
      Divide(x=w7, y=$"Bin Size") -> w8
      Array Size(array=$"Input Complex Samples") -> (size(s)=w9)
      Max And Min(x=w9, y=3000) -> (min(x,y)=w10: i32)
      Quotient And Remainder(x=w10, y=$"Bin Size") -> (floor(x/y)=w11)
      for (N = w11) (iteration -> i1) {
        Multiply($"Bin Size", i1) -> w12
        Array Subset(array=w8, index0=w12, length0=$"Bin Size") -> w13
        Add Array Elements(numeric array=w13) -> (sum=w14)
        append w14 to w5
      }
      Array Max And Min(array=w5) -> (max value=w3, min value=w2)
      Divide(x=w3, y=w2) -> w15
      Logarithm Base 10(x=w15) -> w16
      Multiply(w16, 20) -> w17
      Is Less(x=w17, y=3) -> w4
      Add(w3, w2) -> w18
      Divide(x=w18, y=2) -> w19
      Multiply(w2, 100) -> w20
      Max And Min(x=w19, y=w20) -> (max(x,y)=w21: f64)
      Max And Min(x=1e-06, y=w21) -> (max(x,y)=w1: f64)
    }
    frame True {
      Complex To Polar(r * e^(i*theta)=$"Input Complex Samples") -> (r=w22)
      Array Size(array=$"Input Complex Samples") -> (size(s)=w23)
      Max And Min(x=w23, y=3000) -> (min(x,y)=w24: i32)
      Divide(x=w24, y=$"Bin Size") -> w25
      Round Toward Negative Infinity(x=w25) -> w26
      To Long Integer(number=w26) -> w27
      for (N = w27) (iteration -> i2) {
        Multiply($"Bin Size", i2) -> w29
        Array Subset(array=w22, index0=w29, length0=$"Bin Size") -> w30
        Absolute Value(x=w30) -> w31
        Square(x=w31) -> w32
        Divide(x=w32, y=$"Bin Size") -> w33
        Add Array Elements(numeric array=w33) -> (sum=w34)
        append w34 to w28
      }
      Math Node("power"=w28, "bin_num"=w27) -> ("noise_power"=w2, "energy_threshold"=w1, "signal_power"=w3, "noise_estimation_error"=w4, "power"=w5)
      ~~~
      %Keep the power in the lower fraction of bins

      low_lim = max(1,floor(0.1*bin_num));
      %z =sort(power);
      %noise_power = mean(z(1:low_lim));
      noise_power = min(power);
      signal_power=  max(power );
      %signal_power= mean(z(bin_size-low_lim:end));

      %energy_threshold = max(.01, min(0.009,noise_power*1000));
      energy_threshold = max([noise_power*100, (noise_power+signal_power)/2, 1e-6] );

      noise_estimation_error = 0;
      if 20*log(signal_power/noise_power) < 3
         noise_estimation_error=1;
      end
      ~~~
    }
  }
  $power <- w5
  $signal_power <- w3
  $"noise_estimation_error ?" <- w4
  $"Energy Threshold" <- w1
  $noise_power <- w2
