vi "Rx_bitstreamtosound.gvi"   [LabVIEW NXG]
inputs:
  "mult": f64 = 100000
  "volume": f64 = 100
  "positive_value_corr": f64 = 100000
  "samp_pr_chan": i32 = 100000
panel controls:
  "queue_type": i16[]
  "stop": bool
panel indicators:
  "bit_wave_out": waveform<f64>[]
  "x - y": f64[]
  "element": i16[]
  "output waveform": waveform<f64>
  "x = y?": bool[]
  "number pending insert": i32
  "number pending remove": i32
  "number elements in queue": i32
  "sum": i16[]
  "16-bit integer": i16[]
types:
  T1 = cluster{"sample rate": f64, "number of channels": i32, "bits per sample": i32}
diagram:
  Obtain Queue(element data type=$queue_type, max queue size (-1, unlimited)=1000, name (unnamed)="Sound_to_bit") -> (queue out=w1)
  w2 = T1 {"sample rate"=8000, "number of channels"=1, "bits per sample"=16}
  call "Sound Output Configure.gvi"(device ID=0, sound format=w2, number of samples per channel=$samp_pr_chan) -> (task ID=w3, error out=w4)
  call "Sound Output Start.gvi"(task ID=w3, error in=w4) -> (task ID out=w5, error out=w6)
  call "Sound Output Set Volume.gvi"(task ID=w5, volume=$volume, error in=w6) -> (task ID out=w7, error out=w8)
  while {
    Dequeue Element(queue=w1) -> (element=w9)
    for {
      w10 = each element of w9
      Is Not Equal To 0(x=w10) -> w12
      append w12 to w11
    }
    Array Size(array=w11) -> (size(s)=w13)
    Divide(x=w13, y=16) -> w14
    for (N = w14) (iteration -> i1) {
      Multiply(16, i1) -> w16
      Array Subset(array=w11, index0=w16, length0=16) -> w17
      Boolean Array To Number[SignExtensionMode=1](Boolean array=w17) -> (number=w18)
      append w18 to w15
    }
    To Word Integer(number=w15) -> w19
    Divide(x=w19, y=$mult) -> w20
    Subtract(x=w20, y=$positive_value_corr) -> w21
    Build Waveform Node(Y=w21, dt=0.000125) -> (output waveform=w22)
    Build Array(w22) -> w23
    call "Sound Output Write.gvi"(task ID=w7, data=w23, error in=w8, timeout=0) -> (task ID out=w24, error out=w25)
    Boolean To Integer(Boolean=w11) -> (0, 1=w26)
    Add(w26, i16[] []) -> w27
    $sum <- w27
    Is Equal(x=w9, y=w19) -> w28
    $"x = y?" <- w28
    $bit_wave_out <- w23
    $"16-bit integer" <- w19
    $"output waveform" <- w22
    $element <- w9
    $"x - y" <- w21
    Get Queue Status(queue=w1) -> (# elements in queue=w29, # pending insert=w30, # pending remove=w31)
    $"number pending remove" <- w31
    $"number pending insert" <- w30
    $"number elements in queue" <- w29
    stop if $stop
  }
  call "Sound Output Stop.gvi"(task ID=w24, error in=w25) -> (task ID out=w32, error out=w33)
  call "Sound Output Clear.gvi"(task ID=w32, error in=w33)
