vi "Tx_packetconstructor.gvi"   [LabVIEW NXG]
inputs:
  "User defined bitstream?": bool = TRUE
outputs:
  "Array": i8[][][]
panel controls:
  "Packet Parameters_2": T1 = {"Guard Bits "=16, "Sync Bits"=32, "Message Bits"=960, "PN sequence order\nfor Sync"=9}
  "Packet Number": i32
  "Cyclic Padding Bits": i32
  "bitstream": i8[] = [1]
  "stop": bool
panel indicators:
  "error out": error
types:
  T1 = cluster{"Guard Bits ": i32, "Sync Bits": i32, "Message Bits": i32, "PN sequence order\nfor Sync": i32}
diagram:
  Property Node(instance in=$"Packet Parameters_2") -> ("Sync Bits"=w1, "PN sequence order\nfor Sync"=w2, "Guard Bits "=w3, "Message Bits"=w4)
  call "MT Generate Bits (Galois, PN Order).gvi"(total bits=w1, PN sequence order=w2, reset?=TRUE) -> (output bit stream=w5, error out=w6)
  $"error out" <- w6
  w7 = $"Packet Number"
  Obtain Queue(element data type=$bitstream, name (unnamed)="Sound_to_bit") -> (queue out=w8)
  Initialize Array(element=1, size=w3) -> w9
  while (iteration -> i1) (after w7) {
    Get Queue Status(queue=w8) -> (queue out=w10)
    Dequeue Element(queue=w10) -> (element=w11)
    Array Size(array=w11) -> (size(s)=w12)
    Divide(x=w12, y=w4) -> w13
    To Long Integer(number=w13) -> w14
    for (N = w14) (iteration -> i2) {
      case ($"User defined bitstream?") {
        frame False, Default {
          call "MT Generate Bits (Galois, PN Order).gvi"(total bits=w4, PN sequence order=11) -> (output bit stream=w16)
        }
        frame True {
          Multiply(i2, w4) -> w17
          Array Subset(array=w11, index0=w17, length0=w4) -> w16
        }
      }
      Build Array(w9, w5, w16, w9) -> w18
      Array Subset(array=w16, length0=$"Cyclic Padding Bits")
      append w18 to w15
    }
    Increment(x=i1) -> w19
    Number To Boolean Array(number=w19) -> (Boolean array=w20)
    Boolean To Integer(Boolean=w20) -> (0, 1=w21)
    To Word Integer(number=w21)
    Is Equal(x=w19, y=w14)
    stop if $stop
  }
  $Array <- w15
