vi "Tx_soundtobitstream.gvi"   [LabVIEW NXG]
inputs:
  "Positive_value_correct": f64 = 100000
  "Packet Message Length (bits)": i32 = 128
  "mult": f64 = 100000
  "samp_pr_chan": i32 = 100000
panel controls:
  "stop": bool
  "queue_type": i16[]
panel indicators:
  "File Length (bits)": i32
  "Number of Packets": i32
  "dt": f64
  "number elements in queue": i32
  "Sound_in": waveform<f64>[]
  "appended array": i16[]
  "32-bit integer": i32
  "Array": i16[][]
types:
  T1 = cluster{"sample rate": f64, "number of channels": i32, "bits per sample": i32}
diagram:
  Obtain Queue(element data type=$queue_type, max queue size (-1, unlimited)=1000, name (unnamed)="Sound_to_bit") -> (queue out=w1)
  w2 = T1 {"sample rate"=8000, "number of channels"=1, "bits per sample"=16}
  call "Sound Input Configure.gvi"(device ID=0, sound format=w2, number of samples per channel=$samp_pr_chan) -> (task ID=w3, error out=w4)
  call "Sound Input Start.gvi"(task ID=w3, error in=w4) -> (task ID out=w5, error out=w6)
  while {
    call "Sound Input Read.gvi"(task ID=w5, error in=w6, number of samples per channel=800) -> (task ID out=w7, data=w8, error out=w9)
    $Sound_in <- w8
    for {
      w10 = each element of w8
      Property Node(instance in=w10) -> ("Y"=w11, "dt"=w12)
      $dt <- w12
    }
    Add(w11, $Positive_value_correct) -> w13
    Multiply($mult, w13) -> w14
    To Word Integer(number=w14) -> w15
    for {
      w16 = each element of w15
      Number To Boolean Array(number=w16) -> (Boolean array=w18)
      Boolean To Integer(Boolean=w18) -> (0, 1=w19)
      append w19 to w17
    }
    $Array <- w17
    To Word Integer(number=w17) -> w20
    Array Size(array=w20) -> (size(s)=w21)
    Multiply Array Elements(numeric array=w21) -> (product=w22)
    Reshape Array(inArray=w20, size=w22) -> w23
    Array Size(array=w23) -> (size(s)=w24)
    $"File Length (bits)" <- w24
    Divide(x=w24, y=$"Packet Message Length (bits)") -> w25
    Round Toward Positive Infinity(x=w25) -> w26
    Multiply(w26, $"Packet Message Length (bits)") -> w27
    Subtract(x=w27, y=w24) -> w28
    To Long Integer(number=w28) -> w29
    Initialize Array(element=0, size=w29) -> w30
    Build Array[ConcatenateInputs=True](w23, w30) -> w31
    $"appended array" <- w31
    $"32-bit integer" <- w29
    To Long Integer(number=w26) -> w32
    $"Number of Packets" <- w32
    Enqueue Element(element=w31, queue=w1)
    Get Queue Status(queue=w1) -> (# elements in queue=w33)
    $"number elements in queue" <- w33
    stop if $stop
  }
  call "Sound Input Stop.gvi"(task ID=w7, error in=w9) -> (task ID out=w34, error out=w35)
  call "Sound Input Clear.gvi"(task ID=w34, error in=w35)
