vi "adjust_Samples_to_sync.gvi"   [LabVIEW NXG]
inputs:
  "wanted_sync_index": f64
  "current_sync_index": f64
  "packet_size_with_padding": f64
  "first_interation?": bool
  "sync_location_last_iteration": f64
  "samples_last_interation": f64
outputs:
  "new_NumOfSamples": f64
diagram:
  Feedback Node(Initializer=FALSE, Input=w1) -> (Output=w2)
  case ($"first_interation?") {
    frame False, Default {
      Divide(x=$current_sync_index, y=$wanted_sync_index) -> w4
      Is Greater(x=w4, y=1.02) -> w5
      Is Less(x=w4, y=0.98) -> w6
      Is Greater(x=$current_sync_index, y=$sync_location_last_iteration) -> w7
      Reciprocal(x=w4) -> w8
      Is Greater Or Equal(x=w8, y=2) -> w9
      Round Toward Negative Infinity(x=w4) -> w10
      Is Greater Or Equal(x=w10, y=2) -> w11
      Subtract(x=$current_sync_index, y=$sync_location_last_iteration) -> w12
      Absolute Value(x=w12) -> w13
      Is Greater(x=w13, y=2) -> w14
      case (w5) {
        frame False, Default {
          # Sync index not too high
          case (w6) {
            frame False, Default {
              # Sync index in range
              w3 = $samples_last_interation
              w1 = w2
            }
            frame True {
              # Sync index too low
              case (w7) {
                frame False, Default {
                  # Sync index decreasing
                  case (w2) {
                    frame False, Default {
                      # Didn't decrement
                      # last iteration
                      Decrement(x=$samples_last_interation) -> w3
                      Not(x=w2) -> w1
                    }
                    frame True {
                      # Decremented
                      # last iteration
                      Not(x=w2) -> w1
                      w3 = $samples_last_interation
                    }
                  }
                }
                frame True {
                  # Sync index increasing
                  case (w9) {
                    frame False, Default {
                      # Not less than half
                      w3 = $samples_last_interation
                      w1 = w2
                    }
                    frame True {
                      # Less than half
                      Decrement(x=$samples_last_interation) -> w3
                      w1 = w2
                    }
                  }
                }
              }
            }
          }
        }
        frame True {
          # Current sync index too high
          case (w7) {
            frame False, Default {
              # Sync index decreasing
              case (w14) {
                frame False, Default {
                  # Not decreasing too fast
                  case (w11) {
                    frame False, Default {
                      # Sync index decreasing
                      # and in range
                      w3 = $samples_last_interation
                    }
                    frame True {
                      # Sync index more
                      # than double
                      Increment(x=$samples_last_interation) -> w3
                    }
                  }
                }
                frame True {
                  # Decreasing too fast
                  Decrement(x=$samples_last_interation) -> w3
                }
              }
            }
            frame True {
              # Sync index increasing
              # Increment samples to
              # decrease sync index
              Increment(x=$samples_last_interation) -> w3
            }
          }
          w1 = w2
        }
      }
    }
    frame True {
      w3 = $packet_size_with_padding
      w1 = w2
    }
  }
  $new_NumOfSamples <- w3
