vi "testing_vi_without_usrp.gvi"   [LabVIEW NXG]
panel controls:
  "stopRecoringSound": bool
  "stopSendingData": bool
  "number of samples": i64 = 100000
  "row index": i32
  "stopFetchingLoop": bool
  "PSK type_2": enum{"normal", "shifted", "offset"} = "normal"
  "samples per symbol_2": i32 = 16
  "M-PSK": i32 = 4
  "modulation type_2": T2 = "PSK"
  "pulse shaping filter_2": T3 = "Root Raised Cos"
  "filter parameter_2": f64 = 0.5
  "IQ_Rate": f64 = 400000
  "modulation type": T2 = "PSK"
  "PSK type": enum{"normal", "shifted", "offset"} = "normal"
  "samples per symbol": i32 = 16
  "pulse shaping filter": T3 = "Root Raised Cos"
  "filter parameter": f64 = 0.5
  "filter length": i32 = 8
  "stopDataEnqueing": bool
  "pos_corr": f64 = 0.25
  "mult": f64 = 150
panel indicators:
  "dt": f64
  "data": waveform<f64>[]
  "inDbl": f64[]
  "sizeOfdblArray": i32
  "OutDbl": f64[]
  "InDlb_maxValue": f64
  "InDlb_minValue": f64
  "OutDlb_maxValue": f64
  "OutDlb_minValue": f64
  "array2Queue": i8[]
  "array2Queue_size": i32
  "loop iteration": i32
  "soundBufferFull?": bool
  "PacketGraph": cluster{"t0": f64, "dt": f64, "Y": c128[]}
  "queueEmpty?": bool
  "Signal & Noise Power": cluster{"signal_power": f64, "noise_power": f64}
  "Sync_Found?": bool
  "sync found index": f64
  "demodBitStream": i8[]
  "Graph": T1[]
  "Graph_2": waveform<f64>[]
  "noElementsInSoundQueue?": bool
  "IQ Graph": T1[]
  "number elements in queue": i32
  "size(s)": i32
  "size(s)_2": i32
  "size(s)_3": i32
  "size(s)_4": i32
  "Graph_3": T1[]
  "size(s)_5": i32
  "Y": c128[]
  "size(s)_6": i32
  "Y_2": c128[]
  "size(s)_7": i32
  "Y_3": c128[]
  "size(s)_8": i32
types:
  T1 = cluster{"constellation": f64[], "oversampled data": f64[]}
  T2 = enum{"FSK", "PSK", "QAM", "MSK", "PAM", "ASK", "CPM"}
  T3 = enum{"none", "Raised Cosine", "Root Raised Cos", "Gaussian"}
  T4 = cluster{"sample rate": f64, "number of channels": i32, "bits per sample": i32}
  T5 = cluster{"samples per symbol (16)": i32, "symbol map": c128[], "differential PSK": enum{"disable", "enable"}, "PSK type": enum{"normal", "shifted", "offset"}}
  T6 = cluster{"expected sync location (symbols)": i32, "sync sequence": c128[], "sync location uncertainty (symbols)": i32, "sync indent (symbols)": i32}
  T7 = cluster{"psk_system_params": T5, "pulse_shaping_filter_coeffs": f64[], "matched_filter_coeffs": f64[], "sync_params": T6, "sync_seq_bits": i8[]}
diagram:
  w1 = $pos_corr
  w2 = $mult
  Obtain Queue(element data type=i8[] [], max queue size (-1, unlimited)=2000, name (unnamed)="sound_bit_stream") -> (error out=w3, queue out=w4)
  w5 = T4 {"sample rate"=8000, "number of channels"=1, "bits per sample"=8}
  call "Sound Input Configure.gvi"(device ID=0, sound format=w5, sample mode=1, number of samples per channel=8000) -> (task ID=w6, error out=w7)
  call "Sound Input Start.gvi"(task ID=w6, error in=w7) -> (task ID out=w8, error out=w9)
  while (iteration -> i1) {
    call "Sound Input Read.gvi"(task ID=w8, error in=w9, number of samples per channel=1015, timeout=-1) -> (task ID out=w10, data=w11, error out=w12)
    for {
      w13 = each element of w11
      Property Node(instance in=w13) -> ("Y"=w14, "dt"=w15)
      $dt <- w15
    }
    Add(w14, w1) -> w16
    Multiply(w2, w16) -> w17
    Array Max And Min(array=w17) -> (max value=w18, min value=w19)
    $OutDlb_maxValue <- w18
    Array Max And Min(array=w14) -> (max value=w20, min value=w21)
    $InDlb_maxValue <- w20
    $OutDlb_minValue <- w19
    $InDlb_minValue <- w21
    $data <- w11
    Array Size(array=w14) -> (size(s)=w22)
    $sizeOfdblArray <- w22
    $OutDbl <- w17
    $inDbl <- w14
    To Byte Integer(number=w17) -> w23
    for {
      w24 = each element of w23
      Number To Boolean Array(number=w24) -> (Boolean array=w26)
      Boolean To Integer(Boolean=w26) -> (0, 1=w27)
      To Byte Integer(number=w27) -> w28
      append w28 to w25
    }
    Reshape Array(inArray=w25, size=8120) -> w29
    $array2Queue <- w29
    Array Size(array=w29) -> (size(s)=w30)
    $array2Queue_size <- w30
    call "createPacket.gvi"(dataBitStream=w29, Sync bits=32, PN sync order=9, guard bits=20) -> (packet=w31)
    Get Queue Status(error in (no error)=w3, queue=w4) -> (# elements in queue=w32, error out=w33, max queue size=w34)
    Enqueue Element(element=w31, error in (no error)=w33, queue=w4)
    Is Greater(x=w34, y=w32) -> w35
    $"soundBufferFull?" <- w35
    $"loop iteration" <- i1
    stop if $stopRecoringSound
  }
  call "Sound Input Stop.gvi"(task ID=w10, error in=w12) -> (task ID out=w36, error out=w37)
  call "Sound Input Clear.gvi"(task ID=w36, error in=w37)
  w38 = $"samples per symbol"
  w39 = $"PSK type"
  w40 = $"modulation type"
  w41 = $"pulse shaping filter"
  w42 = $"filter parameter"
  w43 = $"filter length"
  w44 = $IQ_Rate
  w45 = cluster{"t0": f64, "dt": f64, "Y": c128[]} {"t0"=0, "dt"=1, "Y"=[]}
  Obtain Queue(element data type=w45, max queue size (-1, unlimited)=50, name (unnamed)="enqueDataForRadio") -> (error out=w46, queue out=w47)
  while {
    Get Queue Status(error in (no error)=w3, queue=w4) -> (# elements in queue=w48, error out=w49)
    Dequeue Element(error in (no error)=w49, queue=w4) -> (element=w50, error out=w51)
    call "modulation_block.gvi"(modulation type=w40, PSK type=w39, pulse shaping filter=w41, filter parameter=w42, filter length=w43, input bit stream=w50, samples per symbol=w38, IQ_Rate=w44) -> (modulated_complex_waveform=w52)
    Property Node(instance in=w52) -> ("Y"=w53)
    Array Size(array=w53) -> (size(s)=w54)
    $"size(s)_8" <- w54
    Get Queue Status(error in (no error)=w51, queue=w47) -> (# elements in queue=w55, max queue size=w56, queue out=w57)
    Enqueue Element(element=w52, error in (no error)=w51, queue=w57)
    Array Size(array=w50) -> (size(s)=w58)
    $"size(s)" <- w58
    Is Greater(x=w56, y=w55)
    Is Equal To 0(x=w48) -> w59
    $"noElementsInSoundQueue?" <- w59
    $Y_3 <- w53
    stop if $stopDataEnqueing
  }
  call "createEmptyCluster.gvi"() -> (Cluster=w60)
  w61 = cluster{"t0": f64, "dt": f64, "Y": c128[]} {all zero or empty}
  Obtain Queue(element data type=w61, name (unnamed)="sendeq") -> (queue out=w62)
  while (after w60) {
    Get Queue Status(error in (no error)=w46, queue=w47) -> (# elements in queue=w63, error out=w64)
    Dequeue Element(error in (no error)=w64, queue=w47) -> (element=w65)
    call "addPadding.gvi"(dataIn=w65) -> (paddedDataOut=w66)
    Property Node(instance in=w66) -> ("Y"=w67)
    Array Size(array=w67) -> (size(s)=w68)
    $"size(s)_6" <- w68
    $Y <- w67
    Enqueue Element(element=w66, queue=w62)
    call "MT Format Constellation.gvi"(waveform=w66) -> (constellation graph=w69)
    $"IQ Graph" <- w69
    Property Node(instance in=w65) -> ("Y"=w70)
    $Y_2 <- w70
    Is Equal To 0(x=w63) -> w71
    $"queueEmpty?" <- w71
    $PacketGraph <- w66
    $"number elements in queue" <- w63
    Array Size(array=w70) -> (size(s)=w72)
    $"size(s)_7" <- w72
    stop if $stopSendingData
  }
  call "initPSK.gvi"(PSK type=$"PSK type_2", samples per symbol=$"samples per symbol_2", M-PSK=$"M-PSK", modulation type=$"modulation type_2", pulse shaping filter=$"pulse shaping filter_2", filter parameter=$"filter parameter_2", PSK_params_in=T7 {all zero or empty}) -> (PSK_params_out=w73)
  w74 = cluster{"t0": f64, "dt": f64, "Y": c128[]} {all zero or empty}
  w75 = T4 {"sample rate"=8000, "number of channels"=1, "bits per sample"=8}
  call "Sound Output Configure.gvi"(device ID=0, sound format=w75, number of samples per channel=8000) -> (task ID=w76, error out=w77)
  call "Sound Output Start.gvi"(task ID=w76, error in=w77) -> (task ID out=w78)
  s1 = w74  # shift register
  s2 = uninitialised  # shift register
  while {
    call "sub_NoiseEst_And_Chop_Shell.gvi"(data=s1) -> (Output Packets=w79, Signal & Noise Power=w80)
    Property Node(instance in=w79) -> ("Packets"=w81)
    Array Index(array=w81) -> (out0[$"row index", _]=w82)
    Array Size(array=w82) -> (size(s)=w83)
    $"size(s)_5" <- w83
    Dequeue Element(queue=w62) -> (element=w84)
    Property Node(instance in=w84) -> ("dt"=w85)
    w86 = cluster{"t0": f64, "dt": f64, "Y": c128[]} {all zero or empty}
    Property Node(instance in=w86, "Y"=w82, "dt"=w85) -> (instance out=w87)
    $"Signal & Noise Power" <- w80
    call "demodulation_block.gvi"(data=s2, PSK_params_in=w73) -> (output bit stream=w88, recovered complex waveform=w89, Sync_Found?=w90, sync found index=w91)
    call "chopBitStream.gvi"(appendedArray=w88) -> (dataArray=w92)
    Array Size(array=w92) -> (size(s)=w93)
    $"size(s)_4" <- w93
    call "soundBitStream2Integer_2.gvi"(bitStream=w92) -> (integerArray=w94)
    To Double Precision Float(number=w94) -> w95
    Divide(x=w95, y=w2) -> w96
    Subtract(x=w96, y=w1) -> w97
    Property Node(instance in=waveform<f64> {dt=1, Y=[]}, "Y"=w97, "dt"=0.000125) -> (instance out=w98)
    Insert Into Array(inArray=waveform<f64>[] [], index0=0, new=w98) -> w99
    call "Sound Output Write.gvi"(task ID=w78, data=w99) -> (task ID out=w100, error out=w101)
    Array Size(array=w88) -> (size(s)=w102)
    $"size(s)_3" <- w102
    call "MT Format Constellation.gvi"(waveform=s2) -> (constellation graph=w103)
    $Graph_3 <- w103
    $demodBitStream <- w88
    $"Sync_Found?" <- w90
    Array Size(array=w94) -> (size(s)=w104)
    $"size(s)_2" <- w104
    $"sync found index" <- w91
    $Graph_2 <- w99
    call "MT Format Constellation.gvi"(waveform=w89) -> (constellation graph=w105)
    $Graph <- w105
    next s1 = w84
    next s2 = w87
    stop if $stopFetchingLoop
  }
  call "Sound Output Stop.gvi"(task ID=w100, error in=w101) -> (task ID out=w106, error out=w107)
  call "Sound Output Clear.gvi"(task ID=w106, error in=w107)
